# Grasshopper definition ifckit-test-json.gh (Grasshopper 1.0.8)
# plug-ins: Mauc, GrasshopperIFC

rad = Radians(Degrees=Slider(50, range=0..100))
expression = Expression(x=Slider(2000, range=0..10000), Expression="-x")
vec = VectorXYZ(XComponent=0, YComponent=expression, ZComponent=0)  # -> Vector, Length
arc = Arc(Plane=PlaneXY(0, 0, 0), Radius=Slider(3000, range=0..10000), Angle=rad)  # -> Arc, Length
end = EndPoints(Curve=arc.Arc)  # -> Start, End
move = Move(Geometry=vec.Vector, Motion=end.Start)  # -> Geometry, Transform
number_slider = Slider(10000, range=0..10000)
ln = Line(StartPoint=end.Start, EndPoint=move.Geometry)
number_slider_2 = Slider(523, range=0..1000)
rad_2 = Radians(Degrees=Slider(38, range=0..100))
crv = Curve(arc.Arc)
xz = XZPlane(Origin=Point(0, 0, 0))
rotate = Rotate(Geometry=crv, Angle=rad_2, Plane=xz)  # -> Geometry, Transform
vec_2 = VectorXYZ(XComponent=number_slider, YComponent=number_slider, ZComponent=0)  # -> Vector, Length
crv_2 = Curve(rotate.Geometry)
py3 = Python3Script(path_curves=crv_2)  # -> out, a; inputs path_curves: list of Curve
# ---------- py3: Python ----------
import ifckit
import ifckit.rhinokit as rk

if path_curves:
    curves = path_curves if hasattr(path_curves, "__iter__") else [path_curves]
    path = rk.curves_to_path(curves)
    a=path
# ---------- end py3 ----------

number_slider_3 = Slider(300, range=0..1000)
number_slider_4 = Slider(10, range=0..10)
expression_2 = Expression(x=number_slider_3, Expression="x/2")
py3_2 = Python3Script(
    profile_type="I",
    anchor="sw",
    height=number_slider_3,
    width=expression_2,
    web_thickness=number_slider_4,
    flange_thickness=number_slider_4,
    name="I-profiles")  # -> out, json_out; inputs profile_type: String, anchor: String, height: Double, width: Double, web_thickness: Double, flange_thickness: Double, name: String
# ---------- py3_2: Python ----------
"""
gh_profile.py  —  GH Script component: "Create Standard Profile"
================================================================

Stateless component: generates standard steel section profiles.

Component inputs
----------------
profile_type : str  — "I" for I-beam, "L" for L-beam.
height       : float — Total height (I-beam) or leg length A (L-beam), in meters.
width        : float — Flange width (I-beam) or leg length B (L-beam), in meters.
web_thickness: float — Web thickness (I-beam only), in meters.
flange_thickness: float — Flange thickness (both), in meters.
name         : str  — Optional profile name.

Component outputs
-----------------
out      : str — Status message.
json_out : str — JSON string representing the profile as a list of Vec tuples.
                 Can be used as profile input for beams, columns, etc.

Example — I-beam 200 mm height, 100 mm width, 6 mm web, 10 mm flange (in meters):
    profile_type = "I"
    height = 0.2
    width = 0.1
    web_thickness = 0.006
    flange_thickness = 0.01
"""

import json
from ifckit import IBeamProfile, LBeamProfile, Vec

profile_type = (profile_type or "").strip().upper()
messages = []
json_out = ""

if profile_type in ("I", "L"):
    try:
        h = float(height or 0)
        w = float(width or 0)
        wt = float(web_thickness or 0)
        ft = float(flange_thickness or 0)

        if h <= 0 or w <= 0:
            messages.append("ERR: height and width required")
        elif profile_type == "I" and (wt <= 0 or ft <= 0):
            messages.append("ERR: web_thickness and flange_thickness required for I-beam")
        elif profile_type == "L" and ft <= 0:
            messages.append("ERR: flange_thickness required for L-beam")
        else:
            if profile_type == "I":
                profile = IBeamProfile(
                    height=h, width=w, web_thickness=wt, flange_thickness=ft, name=name,
                    anchor=anchor
                )
            else:
                profile = LBeamProfile(
                    height=h, width=w, flange_thickness=ft, name=name, anchor=anchor
                )

            pts = profile.get_profile_points()
            vecs = [Vec(x, y, 0) for x, y in pts]
            profile_data = [v.to_tuple() for v in vecs]

            json_out = json.dumps({"profile": profile_data, "name": name or f"{profile_type}-Profile"})
            messages.append(f"OK  {profile_type}-beam ({h*1000:.0f}×{w*1000:.0f}mm)")
    except Exception as exc:
        messages.append(f"ERR: {exc}")
else:
    messages.append("ERR: profile_type must be 'I' or 'L'")

out = "\n".join(messages) if messages else "No profile processed."
print(out)
# ---------- end py3_2 ----------

vec_3 = VectorXYZ(XComponent=number_slider_2, YComponent=number_slider_2, ZComponent=0)  # -> Vector, Length
hea = HEASection(Height=number_slider_3, Unit="MM", IncludeFillets=Toggle(True))  # -> Section, Info
rec_2pt = Rectangle2Pt(Plane=PlaneXY(0, 0, 0), PointA=Point(0, 0, 0), PointB=vec_3.Vector, Radius=0)  # -> Rectangle, Length
rec_2pt_2 = Rectangle2Pt(Plane=PlaneXY(0, 0, 0), PointA=Point(0, 0, 0), PointB=vec_2.Vector, Radius=0)  # -> Rectangle, Length
revolved_beam = RevolvedBeam(Arc=arc.Arc, Profile=hea.Section, Name="Revolved Beam")  # -> Beam, Info, Preview, Debug
pcen = PolygonCenter(Polyline=rec_2pt.Rectangle)  # -> CenterV, CenterE, CenterA
panel = Panel(crv_2)
pop2d = Populate2D(Region=rec_2pt_2.Rectangle, Count=Slider(100, range=0..100), Seed=1)
move_2 = Move(Geometry=rec_2pt.Rectangle, Motion=pop2d)  # -> Geometry, Transform
py3_3 = Python3Script(arc_curve=crv_2, profile_json=py3_2.json_out, name="swept beam")  # -> out, json_out; inputs arc_curve: Arc, profile_json: String, profile_pts: list of Point3d, name: String
# ---------- py3_3: Python ----------
"""
gh_create_revolved_beam.py  —  GH Script component: "Create IFC Revolved Beam"
================================================================================

Stateless component: serializes arc-based beam paths to JSON strings.
Handles single arc paths → IfcRevolvedAreaSolid via PendingRevolvedBeam.

Component inputs
----------------
arc_curve    : Rhino ArcCurve — The arc sweep path (center, start, angle).
profile_pts  : list — Rhino Point3d objects defining the cross-section
                    polygon in the local XY plane (X = width, Y = up).
                    Minimum 3 points; no closing duplicate needed.
profile_json: str  — JSON string from gh_profile.py (alternative to profile_pts).
                    Takes precedence if both are provided.
name         : str  — Optional element name prefix.

Component outputs
-----------------
out      : str  — Status message.
json_out : list — List of JSON strings (one per beam).
"""

import math
import json
import os
import sys
import importlib

_fallback_path = r'/Users/Mauc/L140-py-ifckit'
pkg_path = os.environ.get('IFCKIT_PATH', _fallback_path)
if pkg_path not in sys.path:
    sys.path.insert(0, pkg_path)

import ifckit
import ifckit.geometry
import ifckit.builders
import ifckit.builders.beam_factory
import ifckit.builders.revolved_beam
import ifckit.elements
import ifckit.rhinokit

importlib.reload(ifckit.geometry)
importlib.reload(ifckit.elements)
importlib.reload(ifckit.builders)
importlib.reload(ifckit.builders.beam_factory)
importlib.reload(ifckit.builders.revolved_beam)
importlib.reload(ifckit.rhinokit)
importlib.reload(ifckit)

from ifckit import PendingRevolvedBeam, Vec
import ifckit.rhinokit as rk
from ifckit.builders.beam_factory import PathType, classify_path


def _get_profile():
    """Get profile from profile_json or profile_pts."""
    if profile_json:
        try:
            data = json.loads(profile_json)
            pts = data.get("profile", [])
            return [Vec(*pt) for pt in pts]
        except Exception:
            pass

    if profile_pts:
        return rk.pts_to_vecs(profile_pts)

    return None


messages = []
json_outputs = []

if arc_curve:
    arc = rk.arc_to_arc(arc_curve)
    if not arc:
        messages.append("ERR: invalid arc curve")
    else:
        prof = _get_profile()
        if not prof:
            messages.append("ERR: no profile (provide profile_pts or profile_json)")
        else:
            path_type = classify_path(arc)
            if path_type != PathType.SINGLE_ARC:
                messages.append(f"ERR: expected single arc path, got {path_type}")
            else:
                try:
                    el_name = name or "RevolvedBeam"
                    # DEBUG: show the arc being used
                    print(f"DEBUG: arc.start={arc.start}, arc.center={arc.center}, arc.angle={arc.angle}")
                    beam = PendingRevolvedBeam(arc=arc, profile=prof, name=el_name)
                    json_outputs.append(beam.to_json())
                    angle_deg = math.degrees(abs(arc.angle))
                    messages.append(f"OK  {el_name} ({angle_deg:.0f}° arc)")
                except Exception as exc:
                    messages.append(f"ERR {el_name}: {exc}")

elif not arc_curve:
    messages.append("No arc curve")

out = "\n".join(messages) if messages else "No beams processed."
print(out)
json_out = json_outputs if json_outputs else []
# ---------- end py3_3 ----------
crv_3 = Curve(move_2.Geometry)
walls = Python3Script(wall_curves=crv_3, height=Slider(2385, range=0..10000), name="test wall")  # -> out, json_out; inputs wall_curves: list of Polyline, height: Double, name: String
# ---------- walls: Python ----------
"""
gh_create_wall.py  —  GH Script component: "Create IFC Wall"
==============================================================

Stateless component: serializes wall curves to JSON strings.

Component inputs
----------------
wall_curves : list  — One or more closed planar Rhino curves (Polyline or
                      PolylineCurve) representing the wall base footprints.
height      : float — Wall height in the model's length unit.
name        : str   — Optional element name prefix.

Component outputs
-----------------
out     : str  — Status message.
json_out : list — List of JSON strings (one per wall).
"""

import json
import random

import importlib
import ifckit
importlib.reload(ifckit)
# import ifckit.elements
# importlib.reload(ifckit.elements)


from ifckit.elements import RenderStyle
from ifckit import PendingWall, Plane, rhinokit as rk

messages = []
json_outputs = []

if wall_curves:
    curves = wall_curves if hasattr(wall_curves, "__iter__") else [wall_curves]

    for i, crv in enumerate(curves):
        if crv is None:
            continue
        try:
            footprint = rk.polyline_to_vecs(crv)
            el_name = f"{name or 'Wall'}-{i + 1}"
            wall = PendingWall(
                footprint=footprint,
                plane=Plane.world_xy(),
                height=float(height)+random.random()*500-250,
                name=el_name,
                style=RenderStyle(
                    (
                    int(random.random()*255),
                    int(random.random()*255),
                    int(random.random()*255)
                    ),
                    transparency=0.9
                )
            )
            json_outputs.append(wall.to_json())
            messages.append(f"OK  {el_name}")
        except Exception as exc:
            messages.append(f"ERR {el_name}: {exc}")

out = "\n".join(messages) if messages else "No walls processed."
json_out = json_outputs if json_outputs else []
# ---------- end walls ----------
panel_2 = Panel(py3_3.json_out)
py3_4 = Python3Script(storey_name="test storey", elements=flatten(py3_3.json_out))  # -> out, json_out; inputs storey_name: String, elements: list of String
# ---------- py3_4: Python ----------
"""
gh_collector.py — GH Script: "Collect Elements"
================================================

Stateless: merges any element JSON lists into storey structure.

Flow:  [Walls JSON] ─┐
                   ──┼──→ [Collector] ──→ [JSON] ──→ [Export]
     [Beams JSON] ──┘
     [Columns JSON] ─┘

No sticky, no state - pure data flow.

Inputs
------
elements : list — List of JSON strings (any element type: walls, beams, etc.)
storey   : str  — Storey name, e.g. "Ground Floor"

Output
------
out     : str  — Status message.
json_out : str — JSON with {"storeys": {storey_name: elements}}
"""

import json

if not elements:
    out = "No elements"
    json_out = ""
elif not storey_name:
    out = "No storey name"
    json_out = ""
else:
    flat_elements = elements if isinstance(elements, list) else [elements]
    valid = [e for e in flat_elements if e]

    out = f"Collected {len(valid)} elements into '{storey_name}'"
    json_out = json.dumps({"storeys": {storey_name: valid}}, separators=(",", ":"))

print(out)
# ---------- end py3_4 ----------
panel_3 = Panel(walls.json_out)
button = Button()
relative_path = Python3Script(name="test_gh_json")  # -> out, a
# ---------- relative_path: Python ----------
from pathlib import Path
myname = "output/{}.ifc".format(name)
p = Path(ghenv.Component.OnPingDocument().FilePath).parent
 
if name:
    a = str(p / myname)
else:
    a = str(p)
# ---------- end relative_path ----------
relative_path_2 = Python3Script(name="test_gh_json", x=Slider(1, range=0..1), y=Slider(0, range=0..1), z=Slider(1, range=0..1))  # -> out, a
# ---------- relative_path_2: Python ----------
from pathlib import Path
myname = "output/{}_{}_{}_{}.ifc".format(name,x,y,z)
p = Path(ghenv.Component.OnPingDocument().FilePath).parent
 
if name:
    a = str(p / myname)
else:
    a = str(p)
# ---------- end relative_path_2 ----------
ifc_export = Python3Script(
    json_input=py3_4.json_out,
    project_name="test project",
    author="test author",
    unit="MILLIMETRE",
    ifc_output=relative_path.a,
    run_export=Toggle(True),
    run_preview=Toggle(True),
    mesh_quality="supercoarse")  # -> out, a; inputs json_input: String, project_name: String, author: String, unit: String, ifc_output: String, run_export: Boolean, run_preview: Boolean, mesh_quality: String
# ---------- ifc_export: Python ----------
"""
gh_export_json.py  —  GH Script component: "Export IFC from JSON"
===================================================================

Stateless component: builds IFC from JSON, optionally writes to file
and/or previews in the active Rhino document.

Each run is independent - no state, no accumulation.

Component inputs
----------------
json_input     : str  — JSON string from Collector.
project_name   : str  — IFC project name (default "GH Project").
author         : str  — Author string stored in IFC header (default "GH").
unit           : str  — "METRE" or "MILLIMETRE" (default MILLIMETRE).
ifc_output     : str  — Absolute path for the output IFC file (optional).
run_export     : bool — Set True to write the IFC file (requires ifc_output).
run_preview    : bool — Set True to import meshes into the active Rhino doc.
mesh_quality   : str  — Preview tessellation quality
                          (superfine/fine/default/coarse/supercoarse).

Component outputs
-----------------
out  : str  — Status message (element count, file path, or error).

Workflow
--------
1. Wire Collector json_out to json_input here
2. Set run_export=False / run_preview=False while testing - see element count
3. Set run_preview=True  → meshes appear in Rhino viewport (no file needed)
4. Set run_export=True   → IFC file is also written to ifc_output path
5. Each run is independent - no accumulation!
"""

import json
import sys
import importlib
# Ensure local ifckit is on path (for development)
#pkg_path = '/Users/Mauc/L140-py-ifckit'
#if pkg_path not in sys.path:
#    sys.path.insert(0, pkg_path)


# Rhino/Grasshopper: force reload to pick up code changes and avoid
# class-identity mismatches that break isinstance() checks.
import ifckit
import ifckit.json_build
import ifckit.builders
import ifckit.builders.beam_factory
import ifckit.elements
import ifckit.geometry
import ifckit.validator
import ifckit.rhinokit
# Reload in dependency order (parents before children!)
importlib.reload(ifckit.geometry)
importlib.reload(ifckit.elements)
importlib.reload(ifckit.builders)
importlib.reload(ifckit.builders.beam_factory)
importlib.reload(ifckit.rhinokit)
importlib.reload(ifckit.validator)
importlib.reload(ifckit.json_build)
importlib.reload(ifckit)

from ifckit.json_build import build


_project_name = project_name if project_name else "GH Project"
_author = author if author else "GH"
_unit = unit.upper() if unit else "MILLIMETRE"
_quality = mesh_quality if mesh_quality else "default"

out = ""

if not json_input:
    out = "ERROR: no JSON input."
elif not run_export and not run_preview:
    try:
        data = json.loads(json_input)
        total = sum(len(elements) for elements in data.get("storeys", {}).values())
        lines = [f"Model has {total} elements."]
        if ifc_output:
            lines.append(f"Set run_export=True to export to:\n  {ifc_output}")
        lines.append("Set run_preview=True to preview in Rhino.")
        out = "\n".join(lines)
    except json.JSONDecodeError as exc:
        out = f"ERROR: Invalid JSON: {exc}"
else:
    try:
        data = json.loads(json_input)

        project_json = {
            "ifc_version": "IFC4",
            "project": {"name": _project_name, "author": _author},
            "unit": _unit,
            "site": {"name": "Site"},
            "buildings": [
                {
                    "name": "Building",
                    "storeys": [
                        {
                            "name": storey_name,
                            "elevation": 0.0,
                            "elements": [
                                json.loads(elem_json) if isinstance(elem_json, str) else elem_json
                                for elem_json in elements
                            ]
                        }
                        for storey_name, elements in data.get("storeys", {}).items()
                    ]
                }
            ],
        }

        model = build(project_json)
        messages = []

        if run_export:
            if not ifc_output:
                messages.append("EXPORT SKIPPED: ifc_output is empty.")
            else:
                model.save(ifc_output)
                messages.append(f"Exported to:\n  {ifc_output}")

        if run_preview:
            count = model.preview_rhino(mesh_quality=_quality)
            messages.append(f"Previewing {count} elements in Rhino.")

        out = "\n".join(messages)

    except Exception as exc:
        out = f"FAILED: {exc}"

print(out)
# ---------- end ifc_export ----------
py3_5 = Python3Script(ifc_path=relative_path_2.a)  # -> out, a; inputs ifc_path: String
# ---------- py3_5: Python ----------
import Rhino
doc = Rhino.RhinoDoc.ActiveDoc
print(f"Total layers: {len(doc.Layers)}")
# ---------- end py3_5 ----------
panel_4 = Panel(ifc_export.out)
