# Grasshopper definition ifckit-test.gh (Grasshopper 1.0.8)

vec = VectorXYZ(XComponent=Slider(10000, range=0..10000), YComponent=Slider(300, range=0..1000), ZComponent=0)  # -> Vector, Length
rec_2pt = Rectangle2Pt(Plane=PlaneXY(0, 0, 0), PointA=Point(0, 0, 0), PointB=vec.Vector, Radius=0)  # -> Rectangle, Length
crv = Curve(rec_2pt.Rectangle)
py3 = Python3Script()  # -> out, a
# ---------- py3: Python ----------
a={"heloo": "world"}
# ---------- end py3 ----------
py3_2 = Python3Script(
    ifckit_path="/Users/Mauc/L140-py-ifckit/",
    project_name="test project",
    author="test author",
    use_mm=Toggle(True),
    reset=Toggle(True))  # -> out, a, done; inputs ifckit_path: String, project_name: String, author: String, use_mm: Boolean, reset: Boolean
# ---------- py3_2: Python ----------
"""
gh_init_model.py  —  GH Script component: "Init IFC Model"
===========================================================

Paste the contents of this file into a Grasshopper Python 3 Script
component (Rhino 8+).

Execution chain
---------------
This component is the START of a forced-order chain:

    [Init] --done--> [AddWall trigger]
                     [AddWall done] --> [AddBeam trigger]
                                        [AddBeam done] --> [Export trigger]

Wire the ``done`` output of this component to the ``trigger`` input of the
first element component.  This guarantees that Init always completes before
any element is added, preventing stale-storey bugs after a model reset.

Component inputs
----------------
reset        : bool — Boolean Toggle.  Set True to (re-)initialise the
                      model.  Set back to False when done.
project_name : str  — IFC project name  (default "GH Project")
author       : str  — Author string stored in IFC header (default "GH")
use_mm       : bool — True  → LengthUnit.MILLIMETRE  (IFC convention)
                      False → LengthUnit.METRE

Component outputs
-----------------
done : bool — True when the model is ready in sc.sticky.
              Wire this to the ``trigger`` input of the next component.
out  : str  — Status message for a GH panel.
"""


import sys
import scriptcontext as sc
import json

if ifckit_path and ifckit_path not in sys.path:
    sys.path.insert(0, ifckit_path)

from ifckit import IfcModel, IfcSchema, LengthUnit

_project_name = project_name if project_name else "GH Project"
_author = author if author else "GH"
_unit = LengthUnit.MILLIMETRE if use_mm else LengthUnit.METRE

if reset:
    model = IfcModel(name=_project_name, schema=IfcSchema.IFC4, author=_author, unit=_unit)
    site = model.add_site("Site")
    bldg = site.add_building("Building")
    storey = bldg.add_storey("Ground Floor", elevation=0.0)

    sc.sticky["ifckit_model"] = model
    sc.sticky["ifckit_storey"] = storey
    done = True
    out = f"IfcModel '{_project_name}' initialised ({_unit.name})."
else:
    if "ifckit_model" in sc.sticky:
        done = True
        out = f"Model '{sc.sticky['ifckit_model'].name}' ready."
    else:
        done = False
        out = "No model. Set reset=True to initialise."
print (dir(sc.sticky["ifckit_storey"]))
# ---------- end py3_2 ----------
py3_3 = Python3Script(x=py3.a)  # -> out, a
# ---------- py3_3: Python ----------
print(x)
# ---------- end py3_3 ----------
py3_4 = Python3Script(trigger=py3_2.done, wall_curves=crv, height=Slider(3000, range=0..10000), name="test wall", enabled=Toggle(True))  # -> out, flatten(a), done; inputs trigger: Boolean, wall_curves: list of Polyline, height: Double, name: String, enabled: Boolean
# ---------- py3_4: Python ----------
"""
gh_add_wall.py  —  GH Script component: "Add IFC Wall"
=======================================================

Paste the contents of this file into a Grasshopper Python 3 Script
component (Rhino 8+).

Execution chain
---------------
Wire the ``done`` output of the previous component (Init or another
element component) to the ``trigger`` input of this component.  Wire
the ``done`` output of this component to the ``trigger`` of the next.

    [Init done] --> [AddWall trigger]
                    [AddWall done] --> [AddBeam trigger / Export trigger]

This guarantees that Init has completed (and sc.sticky is populated)
before any wall is added.

Component inputs
----------------
trigger     : bool  — Wire from previous component's ``done`` output.
                      This component does nothing unless trigger is True.
wall_curves : list  — One or more closed planar Rhino curves (Polyline or
                      PolylineCurve) representing the wall base footprints.
height      : float — Wall height in the model's length unit.
name        : str   — Optional element name prefix.

Component outputs
-----------------
done : bool — True when all walls have been added to the storey.
              Wire to the next component's ``trigger`` input.
out  : str  — Status / error messages.
"""

import sys
import scriptcontext as sc

from ifckit import PendingWall, validate
from ifckit.geometry import Vec, Plane

# ── converters ────────────────────────────────────────────────────────────────


def _pt(pt):
    return Vec(pt.X, pt.Y, pt.Z)


def _polyline_to_footprint(crv):
    pl = crv.ToPolyline() if hasattr(crv, "ToPolyline") else crv
    pts = [_pt(p) for p in pl]
    if len(pts) > 1:
        f, l = pts[0], pts[-1]
        if abs(f.x - l.x) < 1e-6 and abs(f.y - l.y) < 1e-6:
            pts = pts[:-1]
    return pts


# ── main ──────────────────────────────────────────────────────────────────────

done = False
messages = []
print(dir(sc.sticky["ifckit_storey"]))
if not trigger:
    out = "Waiting for trigger."
elif "ifckit_storey" not in sc.sticky:
    out = "ERROR: no model in sc.sticky — run Init first (reset=True)."
else:
    storey = sc.sticky["ifckit_storey"]
    curves = wall_curves if hasattr(wall_curves, "__iter__") else [wall_curves]
   # storey.clear()
    for i, crv in enumerate(curves):
        if crv is None:
            continue
        try:
            footprint = _polyline_to_footprint(crv)
            el_name = f"{name or 'Wall'}-{i + 1}"
            wall = PendingWall(
                footprint=footprint,
                plane=Plane.world_xy(),
                height=float(height),
                name=el_name,
            )
            result = validate(wall)
            if result.ok:
                storey.add(wall)
                messages.append(f"OK  {el_name}")
            else:
                messages.append(f"ERR {el_name}: {', '.join(result.errors)}")
            for w in result.warnings:
                messages.append(f"WARN {el_name}: {w}")
        except Exception as exc:
            messages.append(f"ERR curve[{i}]: {exc}")

    done = True
    out = "\n".join(messages) if messages else "No walls processed."
print(out)
# ---------- end py3_4 ----------
py3_5 = Python3Script(x=py3_2.a)  # -> out, a
# ---------- py3_5: Python ----------
print(x.to_dict())
# ---------- end py3_5 ----------
panel = Panel(py3_2.a)
panel_2 = Panel(py3_4.done)
relative_path = Python3Script(x="output/test_gh.ifc")  # -> out, a
# ---------- relative_path: Python ----------
from pathlib import Path
p = Path(ghenv.Component.OnPingDocument().FilePath).parent
 
if x:
    a = str(p / x)
else:
    a = str(p)
# ---------- end relative_path ----------
py3_6 = Python3Script(trigger=py3_4.done, elements=py3_4.a, output_path=relative_path.a, run=Toggle(True))  # -> out, a; inputs trigger: Boolean, elements: list, output_path: String, run: Boolean
# ---------- py3_6: Python ----------
"""
gh_export.py  —  GH Script component: "Export IFC"
====================================================

Paste the contents of this file into a Grasshopper Python 3 Script
component (Rhino 8+).  This component is the END of the execution chain.

Execution chain
---------------
    [Init done] --> [AddWall done] --> [AddBeam done] --> [Export trigger]

Wire the ``done`` output of the last element component to the ``trigger``
input here.  This guarantees all elements are in the model before export.

Component inputs
----------------
trigger     : bool — Wire from previous component's ``done`` output.
output_path : str  — Absolute path for the output IFC file, e.g.
                     "/Users/sander/output/model.ifc"
run         : bool — Boolean Toggle.  Set True to actually write the file.
                     When False the component reports how many elements are
                     in the model without writing anything.

Component outputs
-----------------
out : str — Status message (element count, file path, or error).

Workflow
--------
1. Set run=False while adjusting geometry.
2. When ready: set run=True → file is written.
3. To rebuild from scratch: flip run=False, reset Init (reset=True),
   then set run=True again.
"""

import scriptcontext as sc

done = False
out = ""

if not trigger:
    out = "Waiting for trigger."
elif "ifckit_model" not in sc.sticky:
    out = "ERROR: no model in sc.sticky — run Init first (reset=True)."
elif not output_path:
    out = "ERROR: output_path is empty."
elif not run:
    out = f"Model ready. Set run=True to export to:\n  {output_path}"
else:
    try:
        model = sc.sticky["ifckit_model"]
        model.export(output_path)
        done = True
        out = f"Exported to:\n  {output_path}"
    except Exception as exc:
        out = f"EXPORT FAILED: {exc}"

print(out)
# ---------- end py3_6 ----------
panel_3 = Panel(py3_6.out)
