# Grasshopper definition hello wall.gh (Grasshopper 1.0.8)

number_slider = Slider(200, range=0..1000)
number_slider_2 = Slider(3000, range=0..9000)

# ---- group: ifckit / Export
ifckit_build_json = IfckitBuildJSON()  # -> out, json_out; inputs storeys: list of String, project_name: String, author: String, unit: String, ifc_version: String
# ---------- ifckit_build_json: Python ----------
#
# gh_build_json.py  —  GH Script component: "ifckit Build JSON"
# ==============================================================
#
# @component  nickname:"ifckit Build JSON"
# @group "Export"
# @input  storeys      : str  list — Storey bundle JSON strings from gh_storey nodes
# @input  project_name : str  item — IFC project name (default "GH Project")
# @input  author       : str  item — Author string (default "GH")
# @input  unit         : str  item — "METRE" or "MILLIMETRE" (default "MILLIMETRE")
# @input  ifc_version  : str  item — "IFC2X3" or "IFC4" (default "IFC2X3")
# @output out      : str item — Status message
# @output json_out : str item — Full IFC project JSON for Export node
#
# Assembles storeys into a project JSON ready for gh_export_json.
# Openings and their fills are nested inside elements (no flat openings/doors/windows arrays).
# door_types / window_types are hoisted from storey bundles to project root.
#
# Storey bundle format (from gh_storey):
#     {
#         "storey_name": "Ground Floor",
#         "elevation": 0.0,
#         "elements":     [...],   ← openings nested inside elements
#         "door_types":   [...],   ← hoisted to root
#         "window_types": [...]    ← hoisted to root
#     }

import json
from ifckit import rhinokit as rk

out = ""
json_out = ""

if not storeys:
    out = "ERROR: no storey input."
else:
    try:
        _project_name = str(project_name) if project_name else "GH Project"
        _author       = str(author) if author else "GH"
        _unit         = str(unit).upper() if unit else "MILLIMETRE"
        _ifc_version  = str(ifc_version).upper() if ifc_version else "IFC2X3"

        inputs = storeys if isinstance(storeys, list) else [storeys]

        storeys_out   = []
        door_types    = []
        window_types  = []
        total_elems   = 0

        for raw in inputs:
            s = str(raw).strip()
            if not s:
                continue
            bundle = json.loads(s)

            elems = rk.parse_json_list(bundle.get("elements", []))

            # Hoist type arrays to root — deduplicate by type_key/name.
            for dt in rk.parse_json_list(bundle.get("door_types", [])):
                key = dt.get("type_key") or dt.get("name")
                if not any((x.get("type_key") or x.get("name")) == key for x in door_types):
                    door_types.append(dt)

            for wt in rk.parse_json_list(bundle.get("window_types", [])):
                key = wt.get("type_key") or wt.get("name")
                if not any((x.get("type_key") or x.get("name")) == key for x in window_types):
                    window_types.append(wt)

            storeys_out.append({
                "name":      bundle.get("storey_name", "Storey"),
                "elevation": float(bundle.get("elevation", 0.0)),
                "elements":  elems,
            })
            total_elems += len(elems)

        project_json = {
            "ifc_version": _ifc_version,
            "project":     {"name": _project_name, "author": _author},
            "unit":        _unit,
            "site":        {"name": "Site"},
            "buildings":   [{"name": "Building", "storeys": storeys_out}],
        }
        if door_types:
            project_json["door_types"] = door_types
        if window_types:
            project_json["window_types"] = window_types

        n_openings = sum(
            len(e.get("openings", []))
            for s in storeys_out for e in s.get("elements", [])
            if isinstance(e, dict)
        )
        n_fills = sum(
            len(op.get("doors", [])) + len(op.get("windows", []))
            for s in storeys_out for e in s.get("elements", [])
            if isinstance(e, dict)
            for op in e.get("openings", [])
        )

        out = (
            "Built: {} elements, {} openings, {} fills, "
            "{} door types, {} window types across {} storey(s).".format(
                total_elems, n_openings, n_fills,
                len(door_types), len(window_types), len(storeys_out),
            )
        )
        json_out = json.dumps(project_json, separators=(",", ":"))

    except Exception as exc:
        out = f"FAILED: {exc}"
# ---------- end ifckit_build_json ----------
ifckit_export_ifc = IfckitExportIFC()  # -> out, model_ready; inputs json_input: String, ifc_output: String, run_export: Boolean, run_preview: Boolean, mesh_quality: String, sticky_key: String
# ---------- ifckit_export_ifc: Python ----------
#
# gh_export_json.py  —  GH Script component: "ifckit Export IFC"
# ===============================================================
#
# @component  nickname:"ifckit Export IFC"
# @group "Export"
# @input  json_input   : str  item — Full IFC project JSON from Build JSON node
# @input  ifc_output   : str  item — Absolute path for the output .ifc file (optional)
# @input  run_export   : bool item — Set True to write the IFC file
# @input  run_preview  : bool item — Set True to import meshes into Rhino
# @input  mesh_quality : str  item — Preview tessellation quality (default "default")
# @input  sticky_key   : str  item — sc.sticky key (default "ifckit_model")
# @output out         : str item — Status message
# @output model_ready : int item — Increments on every successful build
#
# Builds an IFC model from JSON, optionally exports to file and/or previews
# meshes in Rhino, and stores the model in sc.sticky for downstream drawing nodes.

import json

from ifckit.json_build import build

import scriptcontext as sc

_quality    = mesh_quality if mesh_quality else "default"
_sticky_key = sticky_key   if sticky_key   else "ifckit_model"
_ver_key    = _sticky_key + "_version"

out         = ""
model_ready = sc.sticky.get(_ver_key, 0)  # expose current version even when idle

if not json_input:
    out = "ERROR: no JSON input."
elif not run_export and not run_preview:
    try:
        data = json.loads(json_input)
        total = sum(
            len(s.get("elements", []))
            for b in data.get("buildings", [])
            for s in b.get("storeys", [])
        )
        lines = [f"Model has {total} elements."]
        if ifc_output:
            lines.append(f"Set run_export=True to export to:\n  {ifc_output}")
        lines.append("Set run_preview=True to preview in Rhino.")
        out = "\n".join(lines)
    except json.JSONDecodeError as exc:
        out = f"ERROR: Invalid JSON: {exc}"
else:
    try:
        data  = json.loads(json_input)
        model = build(data)
        messages = []

        if run_export:
            if not ifc_output:
                messages.append("EXPORT SKIPPED: ifc_output is empty.")
            else:
                model.save(ifc_output)
                messages.append(f"Exported to:\n  {ifc_output}")

        if run_preview:
            count = model.preview_rhino(mesh_quality=_quality)
            messages.append(f"Previewing {count} elements in Rhino.")

        # Store model in sticky for drawing nodes.
        sc.sticky[_sticky_key] = model
        sc.sticky[_ver_key]    = sc.sticky.get(_ver_key, 0) + 1
        model_ready            = sc.sticky[_ver_key]
        messages.append(f"Model stored (version {model_ready}).")

        out = "\n".join(messages)

    except Exception as exc:
        import traceback
        out = f"FAILED: {exc}\n{traceback.format_exc()}"

print(out)
# ---------- end ifckit_export_ifc ----------

# ----
vec = VectorXYZ(XComponent=0, YComponent=0, ZComponent=0)  # -> Vector, Length
vec_2 = VectorXYZ(XComponent=Slider(5000, range=0..10000), YComponent=0, ZComponent=0)  # -> Vector, Length
vec_3 = VectorXYZ(XComponent=0, YComponent=number_slider, ZComponent=0)  # -> Vector, Length
vec_4 = VectorXYZ(XComponent=Slider(1091, range=0..10000), YComponent=0, ZComponent=0)  # -> Vector, Length
vec_5 = VectorXYZ(XComponent=0, YComponent=0, ZComponent=number_slider_2)  # -> Vector, Length
vec_6 = VectorXYZ(XComponent=0, YComponent=0, ZComponent=Slider(2352, range=0..9000))  # -> Vector, Length
pt = Point(vec.Vector)
move = Move(Geometry=vec.Vector, Motion=vec_2.Vector)  # -> Geometry, Transform
move_2 = Move(Geometry=move.Geometry, Motion=vec_3.Vector)  # -> Geometry, Transform
move_3 = Move(Geometry=vec.Vector, Motion=vec_5.Vector)  # -> Geometry, Transform
move_4 = Move(Geometry=vec.Vector, Motion=vec_4.Vector)  # -> Geometry, Transform
expression = Expression(x=Slider(406, range=0..1000), Expression="-x")

# ---- group: ifckit / Elements
ifckit_door = IfckitDoor()  # -> out, json_out; inputs overall_width: Double, overall_height: Double, operation_type: String, type_ref: String, name: String, properties: String
# ---------- ifckit_door: Python ----------
#
# gh_create_door.py  —  GH Script component: "ifckit Door"
# =========================================================
#
# @component  nickname:"ifckit Door"
# @group "Elements"
# @input  overall_width  : float item — Overall door width (m)
# @input  overall_height : float item — Overall door height (m)
# @input  operation_type : str   item — Door operation type (SINGLE_SWING_LEFT, SINGLE_SWING_RIGHT, DOUBLE_SWING_LEFT, DOUBLE_SWING_RIGHT, SLIDING_TO_LEFT, SLIDING_TO_RIGHT, NOTDEFINED)
# @input  type_ref       : str   item — Optional type_key or name of an IfcDoorType to assign
# @input  name           : str   item — Optional element name
# @input  properties     : str   item — JSON dict of user properties e.g. {"FireRating": "EI30"}
# @output out      : str  item — Status message
# @output json_out : str  item — Fill envelope JSON: {"doors":[{...}]} — connect to Opening node fills input
#
# Output connects to Opening node (fills input). Opening nests this fill.

import json
from ifckit.elements.opening import PendingDoor
from ifckit import rhinokit as rk


messages = []
json_out = ""

if overall_width and overall_height:
    el_name = str(name) if name else "Door"
    try:
        op_type = str(operation_type).strip().upper() if operation_type else "NOTDEFINED"
        door = PendingDoor(
            overall_width=float(overall_width),
            overall_height=float(overall_height),
            operation_type=op_type,
            type_ref=str(type_ref) if type_ref else None,
            name=el_name,
            properties=rk.parse_user_properties(properties),
        )
        d = door.to_dict()
        json_out = json.dumps({"doors": [d]})
        messages.append(f"OK  {el_name}  {overall_width}x{overall_height}m")
    except Exception as exc:
        messages.append(f"ERR {el_name}: {exc}")
else:
    messages.append("ERR: overall_width and overall_height required")

out = "\n".join(messages) if messages else "No door processed."
# ---------- end ifckit_door ----------
ifckit_window = IfckitWindow()  # -> out, json_out; inputs overall_width: Double, overall_height: Double, window_type: String, type_ref: String, name: String, properties: String
# ---------- ifckit_window: Python ----------
#
# gh_create_window.py  —  GH Script component: "ifckit Window"
# =============================================================
#
# @component  nickname:"ifckit Window"
# @group "Elements"
# @input  overall_width  : float item — Overall window width (m)
# @input  overall_height : float item — Overall window height (m)
# @input  window_type    : str   item — Window type (SINGLE_PANEL, SIDE_HUNG_RIGHT_HAND, SIDE_HUNG_LEFT_HAND, TILT_AND_TURN_RIGHT_HAND, FIXED_CASEMENT, NOTDEFINED)
# @input  type_ref       : str   item — Optional type_key or name of an IfcWindowType to assign
# @input  name           : str   item — Optional element name
# @input  properties     : str   item — JSON dict of user properties e.g. {"GlazingType": "Double"}
# @output out      : str  item — Status message
# @output json_out : str  item — Fill envelope JSON: {"windows":[{...}]} — connect to Opening node fills input
#
# Output connects to Opening node (fills input). Opening nests this fill.

import json
from ifckit.elements.opening import PendingWindow
from ifckit import rhinokit as rk


messages = []
json_out = ""

if overall_width and overall_height:
    el_name = str(name) if name else "Window"
    try:
        wt = str(window_type).strip().upper() if window_type else "NOTDEFINED"
        win = PendingWindow(
            overall_width=float(overall_width),
            overall_height=float(overall_height),
            window_type=wt,
            type_ref=str(type_ref) if type_ref else None,
            name=el_name,
            properties=rk.parse_user_properties(properties),
        )
        d = win.to_dict()
        json_out = json.dumps({"windows": [d]})
        messages.append(f"OK  {el_name}  {overall_width}x{overall_height}m")
    except Exception as exc:
        messages.append(f"ERR {el_name}: {exc}")
else:
    messages.append("ERR: overall_width and overall_height required")

out = "\n".join(messages) if messages else "No window processed."
# ---------- end ifckit_window ----------
ifckit_opening = IfckitOpening()  # -> out, json_out; inputs insert_plane: Plane, width: Double, height: Double, host_json: String, fills: list of String, name: String, properties: String
# ---------- ifckit_opening: Python ----------
#
# gh_create_opening.py  —  GH Script component: "ifckit Opening"
# ==============================================================
#
# @component  nickname:"ifckit Opening"
# @group "Elements"
# @input  insert_plane : plane item — Insert plane: origin = bottom-centre, X = width direction, Z = outward normal
# @input  width        : float item — Opening width (m)
# @input  height       : float item — Opening height (m)
# @input  host_json    : str   item — Envelope JSON from wall/slab node (element must have an "id")
# @input  fills        : str   list — Fill JSON strings from Door/Window nodes (nested into this opening)
# @input  name         : str   item — Optional element name
# @input  properties   : str   item — JSON dict of user properties e.g. {"FireRating": "EI30"}
# @output out      : str item — Status message
# @output json_out : str item — Updated host envelope JSON with opening (incl. fills) nested inside element
#
# Opening is nested inside the host element. Fills (doors/windows) are nested inside the opening.
# IFC chain: element → openings[] → doors[]/windows[]

import json
from ifckit.elements.opening import PendingOpening
from ifckit import rhinokit as rk


messages = []
json_out = ""

if insert_plane and width and height and host_json:
    try:
        # Parse host envelope — must contain exactly one element with an id.
        host_envelope = json.loads(str(host_json).strip()) if isinstance(host_json, str) else host_json
        elements = rk.parse_json_list(host_envelope.get("elements", []))
        if not elements:
            raise ValueError("host_json contains no elements")
        elem = elements[0]
        if not elem.get("id"):
            raise ValueError("host element has no 'id' — add an id in the wall/slab node")

        # Build opening dict.
        ifc_plane = rk.rhino_plane_to_plane(insert_plane)
        op = PendingOpening(
            plane=ifc_plane,
            width=float(width),
            height=float(height),
            name=str(name) if name else "Opening",
            properties=rk.parse_user_properties(properties),
        )
        op_dict = op.to_dict()

        # Nest fills (doors/windows) into this opening.
        op_dict.setdefault("doors", [])
        op_dict.setdefault("windows", [])
        if fills:
            fill_list = fills if isinstance(fills, list) else [fills]
            for raw in fill_list:
                if not raw:
                    continue
                fill_env = json.loads(str(raw).strip()) if isinstance(raw, str) else raw
                for d in rk.parse_json_list(fill_env.get("doors", [])):
                    op_dict["doors"].append(d)
                for w in rk.parse_json_list(fill_env.get("windows", [])):
                    op_dict["windows"].append(w)

        # Attach opening to element.
        elem.setdefault("openings", [])
        elem["openings"].append(op_dict)

        # Rebuild envelope with updated element.
        elements[0] = elem
        out_envelope = dict(host_envelope)
        out_envelope["elements"] = elements

        n_doors = len(op_dict["doors"])
        n_windows = len(op_dict["windows"])
        messages.append(
            f"OK  {op_dict.get('name')}  {n_doors} door(s), {n_windows} window(s)"
        )
        json_out = json.dumps(out_envelope)

    except Exception as exc:
        messages.append(f"ERR: {exc}")
elif not host_json:
    messages.append("ERR: connect wall/slab json_out to host_json")
elif not insert_plane:
    messages.append("ERR: insert_plane required")
else:
    messages.append("ERR: width and height required")

out = "\n".join(messages) if messages else "No opening processed."
# ---------- end ifckit_opening ----------
ifckit_beam = IfckitBeam()  # -> out, json_out, ids; inputs line_curve: Curve, profile_pts: list of Point3d, profile_json: String, name: String, properties: String, clips: list of Plane
# ---------- ifckit_beam: Python ----------
#
# gh_create_beam.py  —  GH Script component: "ifckit Beam"
# =========================================================
#
# @component  nickname:"ifckit Beam"
# @group "Elements"
# @input  line_curve   : curve  item — LineCurve defining the beam axis
# @input  profile_pts  : point  list — Cross-section polygon as Point3d list (fallback)
# @input  profile_json : str    item — Profile JSON from ifckit Profile node
# @input  name         : str    item — Optional element name
# @input  properties   : str    item — JSON dict of user properties e.g. {"Supplier": "Voortman"}
# @input  clips        : plane  list — Optional clipping planes (z_axis points toward material to keep)
# @output out      : str item — Status message
# @output json_out : str  list — Envelope JSON strings: {"elements":[{...}]}
# @output ids      : str  list — UUID assigned to each beam
#
# Stateless: serializes linear beam paths → IfcExtrudedAreaSolid via PendingBeam.

import json
import uuid

from ifckit import PendingBeam, Vec
from ifckit.profiles import Profile
import ifckit.rhinokit as rk
from ifckit.builders.beam_factory import PathType, classify_path


def _get_profile():
    if profile_json:
        try:
            data = json.loads(profile_json)
            if "profile_type" in data:
                return Profile.dispatch_from_dict(data)
        except Exception:
            pass
    if profile_pts:
        return rk.pts_to_vecs(profile_pts)
    return None


messages = []
json_outputs = []
ids = []

if line_curve:
    line = rk.curves_to_path(line_curve)
    if not line:
        messages.append("ERR: invalid line curve")
    else:
        prof = _get_profile()
        if not prof:
            messages.append("ERR: no profile (provide profile_pts or profile_json)")
        else:
            path_type = classify_path(line)
            if path_type != PathType.SINGLE_LINE:
                messages.append(f"ERR: expected single line path, got {path_type}")
            else:
                try:
                    el_name = name or "Beam"
                    el_id = str(uuid.uuid4())
                    beam = PendingBeam(axis=line, profile=prof, name=el_name,
                                      clips=rk.parse_clips(clips),
                                      properties=rk.parse_user_properties(properties))
                    d = json.loads(beam.to_json())
                    d["id"] = el_id
                    json_outputs.append(json.dumps({"elements": [d]}))
                    ids.append(el_id)
                    messages.append(f"OK  {el_name}  id={el_id[:8]}")
                except Exception as exc:
                    messages.append(f"ERR {el_name}: {exc}")

elif not line_curve:
    messages.append("No line curve")

out = "\n".join(messages) if messages else "No beams processed."
json_out = json_outputs if json_outputs else []
# ---------- end ifckit_beam ----------
ifckit_beam_any_path = IfckitBeamAnyPath()  # -> out, path_type, json_out, ids; inputs path_curve: Curve, profile_pts: list of Point3d, profile_json: String, name: String, properties: String, clips: list of Plane
# ---------- ifckit_beam_any_path: Python ----------
#
# gh_create_beam_any.py  —  GH Script component: "ifckit Beam (Any Path)"
# ========================================================================
#
# @component  nickname:"ifckit Beam (Any Path)"
# @group "Elements"
# @input  path_curve   : curve   item — LineCurve or ArcCurve defining the beam path
# @input  profile_pts  : point   list — Cross-section polygon as Point3d list (fallback)
# @input  profile_json : str     item — Profile JSON from ifckit Profile node
# @input  name         : str     item — Optional element name
# @input  properties   : str     item — JSON dict of user properties e.g. {"Supplier": "Voortman"}
# @input  clips        : plane   list — Optional clipping planes (line beams only; z_axis toward material to keep)
# @output out       : str     item — Status message
# @output path_type : str     item — Detected path type
# @output json_out  : str     list — Envelope JSON strings: {"elements":[{...}]}
# @output ids       : str     list — UUID assigned to each beam
#
# Stateless: auto-detects path type (line → ExtrudedAreaSolid, arc → RevolvedAreaSolid).

import math
import json
import uuid

from ifckit import PendingBeam, PendingRevolvedBeam, Vec
from ifckit.profiles import Profile
import ifckit.rhinokit as rk
from ifckit.builders.beam_factory import PathType, classify_path


def _get_profile():
    if profile_json:
        try:
            data = json.loads(profile_json)
            if "profile_type" in data:
                return Profile.dispatch_from_dict(data)
        except Exception:
            pass
    if profile_pts:
        return rk.pts_to_vecs(profile_pts)
    return None


messages = []
json_outputs = []
ids = []
detected_path_type = ""

if path_curve:
    line = rk.curves_to_path(path_curve)
    if line:
        path = line
        detected_path_type = classify_path(path)
    else:
        arc = rk.arc_to_arc(path_curve)
        if arc:
            path = arc
            detected_path_type = classify_path(path)
        else:
            messages.append("ERR: invalid curve (not line or arc)")
            detected_path_type = "unknown"

    if detected_path_type in (PathType.SINGLE_LINE, PathType.SINGLE_ARC):
        prof = _get_profile()
        if not prof:
            messages.append("ERR: no profile (provide profile_pts or profile_json)")
        else:
            try:
                el_name = name or "Beam"
                el_id = str(uuid.uuid4())

                if detected_path_type == PathType.SINGLE_LINE:
                    beam = PendingBeam(axis=path, profile=prof, name=el_name,
                                      clips=rk.parse_clips(clips),
                                      properties=rk.parse_user_properties(properties))
                    solid_type = "ExtrudedAreaSolid"
                else:
                    beam = PendingRevolvedBeam(arc=path, profile=prof, name=el_name,
                                              properties=rk.parse_user_properties(properties))
                    solid_type = "RevolvedAreaSolid"
                    angle_deg = math.degrees(abs(path.angle))

                d = json.loads(beam.to_json())
                d["id"] = el_id
                json_outputs.append(json.dumps({"elements": [d]}))
                ids.append(el_id)

                if detected_path_type == PathType.SINGLE_LINE:
                    messages.append(f"OK  {el_name} ({solid_type})  id={el_id[:8]}")
                else:
                    messages.append(f"OK  {el_name} ({solid_type}, {angle_deg:.0f}° arc)  id={el_id[:8]}")
            except Exception as exc:
                messages.append(f"ERR {el_name}: {exc}")
    elif detected_path_type == PathType.MULTI_SEGMENT:
        messages.append("ERR: multi-segment path not yet implemented")
    elif detected_path_type == PathType.NON_PLANAR:
        messages.append("ERR: non-planar path not yet implemented")
    else:
        if not messages:
            messages.append("ERR: could not classify path")

elif not path_curve:
    messages.append("No path curve")

out = "\n".join(messages) if messages else "No beams processed."
path_type = detected_path_type
json_out = json_outputs if json_outputs else []
# ---------- end ifckit_beam_any_path ----------
ifckit_slab = IfckitSlab()  # -> out, json_out, ids; inputs base_curve: Curve, thickness: Double, name: String, properties: String, clips: list of Plane
# ---------- ifckit_slab: Python ----------
#
# gh_create_slab.py  —  GH Script component: "ifckit Slab"
# =========================================================
#
# @component  nickname:"ifckit Slab"
# @group "Elements"
# @input  base_curve : curve item — Closed curve defining the slab footprint
# @input  thickness  : float item — Slab thickness (m)
# @input  name       : str   item — Optional element name
# @input  properties : str   item — JSON dict of user properties e.g. {"Material": "Concrete"}
# @input  clips      : plane list — Optional clipping planes (z_axis points toward material to keep)
# @output out      : str item — Status message
# @output json_out : str list — Envelope JSON strings: {"elements":[{...}]}
# @output ids      : str list — UUID assigned to each slab
#
# Stateless: serializes slab footprints → keyed envelope JSON strings.

import json
import uuid
from ifckit import PendingSlab, Plane, rhinokit as rk


messages = []
json_outputs = []
ids = []

if base_curve:
    curves = base_curve if hasattr(base_curve, "__iter__") else [base_curve]

    for i, crv in enumerate(curves):
        if crv is None:
            continue
        el_name = f"{name or 'Slab'}-{i + 1}"
        el_id = str(uuid.uuid4())
        try:
            footprint = rk.polyline_to_vecs(crv)
            slab = PendingSlab(
                footprint=footprint,
                plane=Plane.world_xy(),
                thickness=float(thickness),
                name=el_name,
                clips=rk.parse_clips(clips),
                properties=rk.parse_user_properties(properties),
            )
            d = slab.to_dict()
            d["id"] = el_id
            json_outputs.append(json.dumps({"elements": [d]}))
            ids.append(el_id)
            messages.append(f"OK  {el_name}  id={el_id[:8]}")
        except Exception as exc:
            messages.append(f"ERR {el_name}: {exc}")

out = "\n".join(messages) if messages else "No slabs processed."
json_out = json_outputs if json_outputs else []
# ---------- end ifckit_slab ----------
ifckit_wall = IfckitWall()  # -> out, json_out, ids; inputs base_curve: Curve, height: Double, thickness: Double, name: String, properties: String, clips: list of Plane
# ---------- ifckit_wall: Python ----------
#
# gh_create_wall.py  —  GH Script component: "ifckit Wall"
# =========================================================
#
# @component  nickname:"ifckit Wall"
# @group "Elements"
# @input  base_curve : curve item — Base line curve of the wall
# @input  height     : float item — Wall height (m)
# @input  thickness  : float item — Wall thickness (m)
# @input  name       : str   item — Optional element name
# @input  properties : str   item — JSON dict of user properties e.g. {"Material": "Concrete"}
# @input  clips      : plane list — Optional clipping planes (z_axis points toward material to keep)
# @output out      : str item — Status message
# @output json_out : str list — Envelope JSON strings: {"elements":[{...}]}
# @output ids      : str list — UUID assigned to each wall (use as host_id in Opening node)
#
# Stateless: serializes wall curves → keyed envelope JSON strings.
# Each wall gets a stable UUID as its "id" field.

import json
import uuid
from ifckit import PendingWall, Plane, rhinokit as rk


messages = []
json_outputs = []
ids = []

if base_curve:
    curves = base_curve if hasattr(base_curve, "__iter__") else [base_curve]

    for i, crv in enumerate(curves):
        if crv is None:
            continue
        el_name = f"{name or 'Wall'}-{i + 1}"
        el_id = str(uuid.uuid4())
        try:
            footprint = rk.polyline_to_vecs(crv)
            wall = PendingWall(
                footprint=footprint,
                plane=Plane.world_xy(),
                height=float(height),
                name=el_name,
                clips=rk.parse_clips(clips),
                properties=rk.parse_user_properties(properties),
            )
            d = wall.to_dict()
            d["id"] = el_id
            json_outputs.append(json.dumps({"elements": [d]}))
            ids.append(el_id)
            messages.append(f"OK  {el_name}  id={el_id[:8]}")
        except Exception as exc:
            messages.append(f"ERR {el_name}: {exc}")

out = "\n".join(messages) if messages else "No walls processed."
json_out = json_outputs if json_outputs else []
# ---------- end ifckit_wall ----------

# ----
rec_3pt = Rectangle3Pt(PointA=vec.Vector, PointB=move.Geometry, PointC=move_3.Geometry)  # -> Rectangle, Length
pl_3pt = Plane3Pt(PointA=move.Geometry, PointB=pt, PointC=move_3.Geometry)
offset = OffsetCurve(Curve=rec_3pt.Rectangle, Distance=expression, Corners=1)
move_5 = Move(Geometry=move_4.Geometry, Motion=vec_6.Vector)  # -> Geometry, Transform
ln = Line(StartPoint=pt, EndPoint=move.Geometry)
rec_3pt_2 = Rectangle3Pt(PointA=vec.Vector, PointB=move.Geometry, PointC=move_2.Geometry)  # -> Rectangle, Length
pop2d = Populate2D(Region=offset, Count=Slider(13, range=0..100), Seed=1)
pl_origin = PlaneOrigin(Base=pl_3pt, Origin=pop2d)

# ---- group: ifckit / Types
ifckit_windowtype = IfckitWindowType()  # -> out, json_out; inputs overall_width: Double, overall_height: Double, window_type: String, name: String, lining_depth: Double, lining_thickness: Double, transom_thickness: Double, mullion_thickness: Double, panel_depth: Double, panel_operation: String, properties: String
# ---------- ifckit_windowtype: Python ----------
#
# gh_create_window_type.py  —  GH Script component: "ifckit WindowType"
# ======================================================================
#
# @component  nickname:"ifckit WindowType"
# @group "Types"
# @input  overall_width    : float item — Overall window width (m)
# @input  overall_height   : float item — Overall window height (m)
# @input  window_type      : str   item — Window type (SINGLE_PANEL, SIDE_HUNG_RIGHT_HAND, SIDE_HUNG_LEFT_HAND, TILT_AND_TURN_RIGHT_HAND, FIXED_CASEMENT, NOTDEFINED)
# @input  name             : str   item — Type name (also used as type_ref from Window component)
# @input  lining_depth     : float item — Lining depth (m, optional)
# @input  lining_thickness : float item — Lining thickness (m, optional)
# @input  transom_thickness: float item — Transom thickness (m, optional)
# @input  mullion_thickness: float item — Mullion thickness (m, optional)
# @input  panel_depth      : float item — Panel depth (m, optional)
# @input  panel_operation  : str   item — Panel operation (SIDEHUNGRIGHTHAND, SIDEHUUNGLEFTHAND, TILTANDTURNRIGHTHAND, TILTANDTURNLEFTHAND, TOPLEFTHUNG, BOTTOMHUNG, PIVOTHORIZONTAL, PIVOTVERTICAL, SLIDINGVERTICAL, SLIDINGHORIZONTAL, REMOVABLECASEMENT, FIXEDCASEMENT, OTHEROPERATION, NOTDEFINED, optional)
# @input  properties       : str   item — JSON dict of user properties
# @output out      : str item — Status message
# @output json_out : str list — Envelope JSON strings: {"window_types":[{...}]}
#
# Stateless: serializes window type parameters → keyed envelope JSON string.
# Connect json_out to gh_merge, then gh_storey, then gh_build_json.
# Use the name value as type_ref in the ifckit Window component.

import json
from ifckit.elements.types import PendingWindowType
from ifckit import rhinokit as rk


def _opt_float(val):
    if val is None:
        return None
    try:
        return float(val)
    except Exception:
        return None


messages = []
json_outputs = []

if overall_width and overall_height:
    try:
        wt = str(window_type).strip().upper() if window_type else "NOTDEFINED"
        wtype = PendingWindowType(
            overall_width=float(overall_width),
            overall_height=float(overall_height),
            window_type=wt,
            name=str(name) if name else "",
            lining_depth=_opt_float(lining_depth),
            lining_thickness=_opt_float(lining_thickness),
            transom_thickness=_opt_float(transom_thickness),
            mullion_thickness=_opt_float(mullion_thickness),
            panel_depth=_opt_float(panel_depth),
            panel_operation=str(panel_operation).strip() if panel_operation else None,
            properties=rk.parse_user_properties(properties),
        )
        json_outputs.append(json.dumps({"window_types": [wtype.to_dict()]}))
        messages.append(f"OK  WindowType '{wtype.name or wtype.type_key[:8]}'")
    except Exception as exc:
        messages.append(f"ERR WindowType: {exc}")

out = "\n".join(messages) if messages else "No window types processed."
json_out = json_outputs if json_outputs else []
# ---------- end ifckit_windowtype ----------
ifckit_doortype = IfckitDoorType()  # -> out, json_out; inputs overall_width: Double, overall_height: Double, operation_type: String, name: String, lining_depth: Double, lining_thickness: Double, threshold_depth: Double, panel_depth: Double, panel_operation: String, properties: String
# ---------- ifckit_doortype: Python ----------
#
# gh_create_door_type.py  —  GH Script component: "ifckit DoorType"
# ==================================================================
#
# @component  nickname:"ifckit DoorType"
# @group "Types"
# @input  overall_width   : float item — Overall door width (m)
# @input  overall_height  : float item — Overall door height (m)
# @input  operation_type  : str   item — Door operation type (SINGLE_SWING_LEFT, SINGLE_SWING_RIGHT, DOUBLE_SWING_LEFT, DOUBLE_SWING_RIGHT, SLIDING_TO_LEFT, SLIDING_TO_RIGHT, NOTDEFINED)
# @input  name            : str   item — Type name (also used as type_ref from Door component)
# @input  lining_depth    : float item — Lining depth (m, optional)
# @input  lining_thickness: float item — Lining thickness (m, optional)
# @input  threshold_depth : float item — Threshold depth (m, optional)
# @input  panel_depth     : float item — Panel depth (m, optional)
# @input  panel_operation : str   item — Panel operation (SWINGING, DOUBLE_ACTING, SLIDING, FOLDING, REVOLVING, ROLLINGUP, NOTDEFINED, optional)
# @input  properties      : str   item — JSON dict of user properties
# @output out      : str item — Status message
# @output json_out : str list — Envelope JSON strings: {"door_types":[{...}]}
#
# Stateless: serializes door type parameters → keyed envelope JSON string.
# Connect json_out to gh_merge, then gh_storey, then gh_build_json.
# Use the name value as type_ref in the ifckit Door component.

import json
from ifckit.elements.types import PendingDoorType
from ifckit import rhinokit as rk


def _opt_float(val):
    if val is None:
        return None
    try:
        return float(val)
    except Exception:
        return None


messages = []
json_outputs = []

if overall_width and overall_height:
    try:
        op_type = str(operation_type).strip().upper() if operation_type else "NOTDEFINED"
        dt = PendingDoorType(
            overall_width=float(overall_width),
            overall_height=float(overall_height),
            operation_type=op_type,
            name=str(name) if name else "",
            lining_depth=_opt_float(lining_depth),
            lining_thickness=_opt_float(lining_thickness),
            threshold_depth=_opt_float(threshold_depth),
            panel_depth=_opt_float(panel_depth),
            panel_operation=str(panel_operation).strip() if panel_operation else None,
            properties=rk.parse_user_properties(properties),
        )
        json_outputs.append(json.dumps({"door_types": [dt.to_dict()]}))
        messages.append(f"OK  DoorType '{dt.name or dt.type_key[:8]}'")
    except Exception as exc:
        messages.append(f"ERR DoorType: {exc}")

out = "\n".join(messages) if messages else "No door types processed."
json_out = json_outputs if json_outputs else []
# ---------- end ifckit_doortype ----------

# ----
ifckit_wall_2 = IfckitWall(base_curve=rec_3pt_2.Rectangle, height=number_slider_2, thickness=number_slider)  # -> out, json_out, ids; inputs base_curve: Curve, height: Double, thickness: Double, name: String, properties: String, clips: list of Plane; same code as ifckit_wall
number_slider_3 = Slider(400, range=0..1000)
number_slider_4 = Slider(88, range=0..300)
number_slider_5 = Slider(400, range=0..1000)

# ---- group: ifckit / Drawing
ifckit_drawing = IfckitDrawing()  # -> out; inputs model_ready: Int32, drawing_name: String, run: Boolean, hlr_poly: Boolean, mesher_defl: Double, hatch_pattern: String, clear: Boolean, sticky_key: String, dest_plane: Plane
# ---------- ifckit_drawing: Python ----------
#
# gh_drawing.py  —  GH Script component: "ifckit Drawing"
# ========================================================
#
# @component  nickname:"ifckit Drawing"
# @group "Drawing"
# @input  model_ready   : int   item — From Export node; confirms model version
# @input  drawing_name  : str   item — Name of the IfcAnnotation drawing to generate
# @input  run           : bool  item — Set True to generate
# @input  hlr_poly      : bool  item — Use polygonal HLR (default True)
# @input  mesher_defl   : float item — OCC mesher linear deflection in metres (optional)
# @input  hatch_pattern : str   item — Fallback hatch pattern (default "Solid")
# @input  clear         : bool  item — Remove existing curves/hatches first (default True)
# @input  sticky_key    : str   item — sc.sticky key to read model from (default "ifckit_model")
# @input  dest_plane    : plane item — Rhino Plane for drawing placement (optional)
# @output out : str item — Status message
#
# Imports one named IFC drawing (section plane + projection) into the active
# Rhino document as curves and hatches.

from ifckit.rhino_import import IfcSvgImporter

import scriptcontext as sc

# ---------------------------------------------------------------------------
# Resolve inputs
# ---------------------------------------------------------------------------
_sticky_key    = sticky_key    if sticky_key    else "ifckit_model"
_drawing_name  = drawing_name  if drawing_name  else ""
_hlr_poly      = hlr_poly      if hlr_poly is not None else True
_mesher_defl   = float(mesher_defl) if mesher_defl else None
_hatch_pattern = hatch_pattern if hatch_pattern else "Solid"
_clear         = clear         if clear is not None else True
_model_ready   = model_ready   if model_ready is not None else 0

# Destination plane — None means keep drawing on section plane.
_dest_plane = dest_plane if dest_plane is not None else None

out = ""

# ---------------------------------------------------------------------------
# Guards
# ---------------------------------------------------------------------------
if not _drawing_name:
    out = "Set drawing_name to the exact name of the drawing to generate."

elif not run:
    model = sc.sticky.get(_sticky_key)
    if model is None:
        out = (
            f"No model in sc.sticky[{_sticky_key!r}].\n"
            "Run the Export node first, then set run=True here."
        )
    else:
        lines = [
            f"Model ready (version {_model_ready}).",
            f"Drawing: {_drawing_name!r}",
        ]
        if _dest_plane is not None:
            lines.append(f"Destination plane: {_dest_plane.Origin}")
        lines.append("Set run=True to generate.")
        out = "\n".join(lines)

else:
    # -----------------------------------------------------------------------
    # Generate
    # -----------------------------------------------------------------------
    model = sc.sticky.get(_sticky_key)

    if model is None:
        out = (
            f"ERROR: no model found in sc.sticky[{_sticky_key!r}].\n"
            "Run the Export node first."
        )
    else:
        try:
            importer = IfcSvgImporter(hatch_pattern=_hatch_pattern)

            if _clear:
                removed = importer.clear_drawing(_drawing_name)
                clear_msg = f"Cleared {removed} existing objects."
            else:
                clear_msg = ""

            result = importer.import_model(
                model,
                hlr_poly=_hlr_poly,
                mesher_deflection=_mesher_defl,
                drawing_filter=_drawing_name,
                destination_plane=_dest_plane,
            )

            lines = [
                f"Drawing:  {_drawing_name!r}",
                f"Curves:   {result['curves']}",
                f"Hatches:  {result['hatches']}",
            ]
            if _dest_plane is not None:
                lines.append(f"Placed on destination plane: {_dest_plane.Origin}")
            if clear_msg:
                lines.append(clear_msg)
            out = "\n".join(lines)

        except Exception as exc:
            import traceback
            out = f"FAILED: {exc}\n{traceback.format_exc()}"

print(out)
# ---------- end ifckit_drawing ----------
ifckit_svg_curves = IfckitSVGCurves()  # -> out; inputs json_input: String, project_name: String, author: String, unit: String, run: Boolean, ifc_path: String, hlr_poly: Boolean, mesher_defl: Double
# ---------- ifckit_svg_curves: Python ----------
#
# gh_svg_curves.py  —  GH Script component: "ifckit SVG Curves"
# ==============================================================
#
# @component  nickname:"ifckit SVG Curves"
# @group "Drawing"
# @input  json_input   : str   item — JSON string from Build JSON node (or leave empty)
# @input  project_name : str   item — IFC project name (default "GH Project")
# @input  author       : str   item — Author (default "GH")
# @input  unit         : str   item — "METRE" or "MILLIMETRE" (default "MILLIMETRE")
# @input  run          : bool  item — Set True to execute
# @input  ifc_path     : str   item — Path to existing .ifc (overrides json_input)
# @input  hlr_poly     : bool  item — Use polygonal HLR (default True)
# @input  mesher_defl  : float item — OCC mesher deflection in metres (optional)
# @output out : str item — Status message
#
# Generates 2-D section drawings from an IFC model via ifcopenshell.draw,
# parses the SVG and places curves + hatches on structured Rhino layers.

# ---------------------------------------------------------------------------
# Resolve inputs with sensible defaults
# ---------------------------------------------------------------------------
import json

_project_name  = project_name   if project_name   else "GH Project"
_author        = author         if author         else "GH"
_unit          = unit.upper()   if unit           else "MILLIMETRE"
_ifc_path      = ifc_path       if ifc_path       else ""
_hlr_poly      = hlr_poly       if hlr_poly is not None else True
_mesher_defl   = float(mesher_defl) if mesher_defl else None

out = ""

if not run:
    out = "Set run=True to import SVG curves into Rhino."

elif _ifc_path:
    # -----------------------------------------------------------------------
    # Direct IFC file import — bypass JSON build
    # -----------------------------------------------------------------------
    try:
        from ifckit.rhino_import import IfcSvgImporter

        importer = IfcSvgImporter()
        importer.clear()
        result = importer.import_file(
            _ifc_path,
            hlr_poly=_hlr_poly,
            mesher_deflection=_mesher_defl,
        )
        out = (
            f"Imported from file:\n  {_ifc_path}\n"
            f"Curves:  {result['curves']}\n"
            f"Hatches: {result['hatches']}"
        )
    except Exception as exc:
        import traceback
        out = f"FAILED: {exc}\n{traceback.format_exc()}"

elif json_input:
    # -----------------------------------------------------------------------
    # Build IFC from JSON then import
    # -----------------------------------------------------------------------
    try:
        from ifckit.json_build import build

        data = json.loads(json_input)

        project_json = {
            "ifc_version": "IFC4",
            "project": {"name": _project_name, "author": _author},
            "unit": _unit,
            "site": {"name": "Site"},
            "buildings": [
                {
                    "name": "Building",
                    "storeys": [
                        {
                            "name": storey_name,
                            "elevation": 0.0,
                            "elements": [
                                json.loads(elem_json)
                                if isinstance(elem_json, str)
                                else elem_json
                                for elem_json in elements
                            ],
                        }
                        for storey_name, elements in data.get("storeys", {}).items()
                    ],
                }
            ],
        }

        model = build(project_json)
        result = model.preview_rhino_curves(
            clear=True,
            hlr_poly=_hlr_poly,
            mesher_deflection=_mesher_defl,
        )
        out = (
            f"Curves:  {result['curves']}\n"
            f"Hatches: {result['hatches']}"
        )

    except Exception as exc:
        import traceback
        out = f"FAILED: {exc}\n{traceback.format_exc()}"

else:
    out = "ERROR: provide json_input or ifc_path."

print(out)
# ---------- end ifckit_svg_curves ----------

# ----
ifckit_windowtype_2 = IfckitWindowType(
    overall_width=number_slider_3,
    overall_height=number_slider_5,
    window_type="FIXED_CASEMENT",
    name="my-window",
    lining_depth=number_slider_4,
    lining_thickness=Slider(31, range=0..300),
    transom_thickness=Slider(113, range=0..300),
    mullion_thickness=number_slider_4)  # -> out, json_out; inputs overall_width: Double, overall_height: Double, window_type: String, name: String, lining_depth: Double, lining_thickness: Double, transom_thickness: Double, mullion_thickness: Double, panel_depth: Double, panel_operation: String, properties: String; same code as ifckit_windowtype

# ---- group: ifckit / Assemble
ifckit_storey = IfckitStorey()  # -> out, json_out; inputs envelopes: list of String, storey_name: String, elevation: Double
# ---------- ifckit_storey: Python ----------
#
# gh_storey.py  —  GH Script component: "ifckit Storey"
# ======================================================
#
# @component  nickname:"ifckit Storey"
# @group "Assemble"
# @input  envelopes    : str list  — Merged or individual envelope JSON strings
# @input  storey_name  : str item  — Storey name e.g. "Ground Floor"
# @input  elevation    : float item — Storey elevation (m, default 0.0)
# @output out      : str item — Status message
# @output json_out : str item — Storey bundle JSON for gh_build_json
#
# Merges all input envelopes then wraps in a storey bundle:
#
#     {
#         "storey_name": "Ground Floor",
#         "elevation": 0.0,
#         "elements":     [...],   ← openings/fills nested inside elements
#         "door_types":   [...],
#         "window_types": [...]
#     }
#
# door_types / window_types are hoisted to root level by gh_build_json.
# Openings and their door/window fills are nested inside each element.
# Multiple Storey nodes can feed one gh_build_json (one per floor).

import json
from ifckit import rhinokit as rk

out = ""
json_out = ""

# ── merge all input envelopes via shared helper ───────────────────────────────
merged = rk.merge_envelopes(envelopes) if envelopes else {}

# ── build storey bundle ──────────────────────────────────────────────────────
_name = str(storey_name) if storey_name else "Storey"
_elev = float(elevation) if elevation is not None else 0.0

bundle = {
    "storey_name": _name,
    "elevation": _elev,
    "elements":     merged.get("elements", []),
    "door_types":   merged.get("door_types", []),
    "window_types": merged.get("window_types", []),
}

n_elems = len(bundle["elements"])
n_openings = sum(len(e.get("openings", [])) for e in bundle["elements"] if isinstance(e, dict))
n_fills = sum(
    len(op.get("doors", [])) + len(op.get("windows", []))
    for e in bundle["elements"] if isinstance(e, dict)
    for op in e.get("openings", [])
)
counts = {}
if n_elems:    counts["elements"] = n_elems
if n_openings: counts["openings"] = n_openings
if n_fills:    counts["fills"] = n_fills
if bundle["door_types"]:   counts["door_types"] = len(bundle["door_types"])
if bundle["window_types"]: counts["window_types"] = len(bundle["window_types"])

summary = ", ".join(f"{v} {k}" for k, v in counts.items()) if counts else "empty"
out = f"Storey '{_name}' @ {_elev}m: {summary}"
json_out = json.dumps(bundle)
# ---------- end ifckit_storey ----------
ifckit_merge = IfckitMerge()  # -> out, json_out; inputs envelopes: list of String
# ---------- ifckit_merge: Python ----------
#
# gh_merge.py  —  GH Script component: "ifckit Merge"
# ====================================================
#
# @component  nickname:"ifckit Merge"
# @group "Assemble"
# @input  envelopes : str list — Any mix of keyed envelope JSON strings from element nodes
# @output out      : str item — Status message
# @output json_out : str item — Single merged envelope JSON string
#
# Merges any number of keyed envelopes by appending lists per key.
#
# Supported keys: elements, openings, doors, windows, door_types, window_types.
# No deduplication. Order preserved. Unknown keys passed through unchanged.
#
# Example input envelopes:
#     {"elements": [...]}      ← from Wall / Slab / Beam
#     {"openings": [...]}      ← from Opening
#     {"doors":    [...]}      ← from Door
#     {"window_types": [...]}  ← from WindowType
#
# Output:
#     {"elements": [...], "openings": [...], "doors": [...], "window_types": [...]}

import json
from ifckit import rhinokit as rk

out = ""
json_out = ""

if envelopes:
    try:
        merged = rk.merge_envelopes(envelopes)
        counts = {k: len(v) for k, v in merged.items() if isinstance(v, list) and v}
        summary = ", ".join(f"{v} {k}" for k, v in counts.items()) if counts else "empty"
        out = f"Merged: {summary}"
        json_out = json.dumps(merged)
    except Exception as exc:
        out = f"ERR: {exc}"
else:
    out = "No envelopes."
# ---------- end ifckit_merge ----------

# ----
ifckit_window_2 = IfckitWindow(overall_width=number_slider_3, overall_height=number_slider_5, type_ref="my-window", name="my-window")  # -> out, json_out; inputs overall_width: Double, overall_height: Double, window_type: String, type_ref: String, name: String, properties: String; same code as ifckit_window
ifckit_opening_2 = IfckitOpening(
    insert_plane=flatten(pl_origin),
    width=number_slider_3,
    height=number_slider_5,
    host_json=ifckit_wall_2.json_out,
    fills=ifckit_window_2.json_out,
    opening_depth=Slider(1000, range=0..1000))  # -> out, json_out; inputs insert_plane: Plane, width: Double, height: Double, host_json: String, fills: list of String, name: String, properties: String, opening_depth: Double
# ---------- ifckit_opening_2: Python ----------
#
# gh_create_opening.py  —  GH Script component: "ifckit Opening"
# ==============================================================
#
# @component  nickname:"ifckit Opening"
# @group "Elements"
# @input  insert_plane : plane item — Insert plane: origin = bottom-centre, X = width direction, Z = outward normal
# @input  width        : float item — Opening width (m)
# @input  height       : float item — Opening height (m)
# @input  host_json    : str   item — Envelope JSON from wall/slab node (element must have an "id")
# @input  fills        : str   list — Fill JSON strings from Door/Window nodes (nested into this opening)
# @input  name         : str   item — Optional element name
# @input  properties   : str   item — JSON dict of user properties e.g. {"FireRating": "EI30"}
# @output out      : str item — Status message
# @output json_out : str item — Updated host envelope JSON with opening (incl. fills) nested inside element
#
# Opening is nested inside the host element. Fills (doors/windows) are nested inside the opening.
# IFC chain: element → openings[] → doors[]/windows[]

import json
from ifckit.elements.opening import PendingOpening
from ifckit import rhinokit as rk
rk.reload_all()

messages = []
json_out = ""

if insert_plane and width and height and host_json:
    try:
        # Parse host envelope — must contain exactly one element with an id.
        host_envelope = json.loads(str(host_json).strip()) if isinstance(host_json, str) else host_json
        elements = rk.parse_json_list(host_envelope.get("elements", []))
        if not elements:
            raise ValueError("host_json contains no elements")
        elem = elements[0]
        if not elem.get("id"):
            raise ValueError("host element has no 'id' — add an id in the wall/slab node")

        # Build opening dict.
        ifc_plane = rk.rhino_plane_to_plane(insert_plane)
        print(ifc_plane)
        op = PendingOpening(
            plane=ifc_plane,
            width=float(width),
            height=float(height),
            name=str(name) if name else "Opening",
            opening_depth=opening_depth,
            anchor="c",
            properties=rk.parse_user_properties(properties),
        )
        print (op)
        op_dict = op.to_dict()
        print(op_dict)
        # Nest fills (doors/windows) into this opening.
        op_dict.setdefault("doors", [])
        op_dict.setdefault("windows", [])
        if fills:
            fill_list = fills if isinstance(fills, list) else [fills]
            for raw in fill_list:
                if not raw:
                    continue
                fill_env = json.loads(str(raw).strip()) if isinstance(raw, str) else raw
                for d in rk.parse_json_list(fill_env.get("doors", [])):
                    op_dict["doors"].append(d)
                for w in rk.parse_json_list(fill_env.get("windows", [])):
                    op_dict["windows"].append(w)

        # Attach opening to element.
        elem.setdefault("openings", [])
        elem["openings"].append(op_dict)

        # Rebuild envelope with updated element.
        elements[0] = elem
        out_envelope = dict(host_envelope)
        out_envelope["elements"] = elements

        n_doors = len(op_dict["doors"])
        n_windows = len(op_dict["windows"])
        messages.append(
            f"OK  {op_dict.get('name')}  {n_doors} door(s), {n_windows} window(s)"
        )
        json_out = json.dumps(out_envelope)

    except Exception as exc:
        messages.append(f"ERR: {exc}")
elif not host_json:
    messages.append("ERR: connect wall/slab json_out to host_json")
elif not insert_plane:
    messages.append("ERR: insert_plane required")
else:
    messages.append("ERR: width and height required")

out = "\n".join(messages) if messages else "No opening processed."
# ---------- end ifckit_opening_2 ----------

# ---- group: ifckit / Preview
ifckit_preview_element = IfckitPreviewElement()  # -> out, preview; inputs json_in: list of String, unit: String
# ---------- ifckit_preview_element: Python ----------
#
# gh_preview_element.py  —  GH Script component: "ifckit Preview Element"
# =========================================================================
#
# @component  nickname:"ifckit Preview Element"
# @group "Preview"
# @input  json_in  : str  list — Collector storey JSON(s) or single element JSON(s)
# @input  unit     : str  item — Length unit of coordinates: "MILLIMETRE" (default) or "METRE"
# @output out      : str  item — Status message
# @output preview  : geometry list — Ephemeral meshes (never added to Rhino doc)

from __future__ import annotations

import traceback

# ---------------------------------------------------------------------------
# Reload (development only — harmless in production)
# ---------------------------------------------------------------------------
try:
    from ifckit.rhinokit import reload_all
    reload_all()
except Exception:
    pass

# ---------------------------------------------------------------------------
# Main
# ---------------------------------------------------------------------------
preview = []
out = ""

try:
    from ifckit.preview import build_preview_meshes

    inputs = json_in if isinstance(json_in, list) else [json_in]
    inputs = [s for s in inputs if s]
    _unit = str(unit).upper() if unit else "MILLIMETRE"

    if not inputs:
        out = "No input"
    else:
        total_meshes = 0
        errors = []

        for s in inputs:
            try:
                meshes = build_preview_meshes(s, unit=_unit)
                preview.extend(meshes)
                total_meshes += len(meshes)
            except Exception as exc:
                errors.append(str(exc))

        parts = [f"{total_meshes} mesh(es)"]
        if errors:
            parts.append(f"{len(errors)} error(s): {'; '.join(errors)}")
        out = ", ".join(parts)

except Exception as exc:
    out = f"ERROR: {exc}\n{traceback.format_exc()}"
# ---------- end ifckit_preview_element ----------

# ---- group: ifckit / Profiles
ifckit_profile = IfckitProfile()  # -> out, json_out, preview; inputs profile_type: String, height: Double, width: Double, web_thickness: Double, flange_thickness: Double, radius: Double, wall_thickness: Double, steel_name: String, anchor: String, unit: String, name: String, rotation: Double, offset_x: Double, offset_y: Double
# ---------- ifckit_profile: Python ----------
#
# gh_profile.py  —  GH Script component: "ifckit Profile"
# =========================================================
#
# @component  nickname:"ifckit Profile"
# @group "Profiles"
# @input  profile_type     : str   item — Profile type: "I","L","rect","circle","hollow_circle","steel"
# @input  height           : float item — Height or leg A (m)
# @input  width            : float item — Width or leg B (m)
# @input  web_thickness    : float item — Web thickness (m) — I-beam only
# @input  flange_thickness : float item — Flange / leg thickness (m)
# @input  radius           : float item — Radius (m) — circle / hollow_circle
# @input  wall_thickness   : float item — Wall thickness (m) — hollow_circle
# @input  steel_name       : str   item — Steel section name, e.g. "HEA200"
# @input  anchor           : str   item — Anchor point: "c" centroid, "s" mid-bottom, "sw" bottom-left (default "c")
# @input  unit             : str   item — Unit for steel dims: "m" (default) or "mm"
# @input  name             : str   item — Optional profile label
# @input  rotation         : float item — CCW rotation of profile around its origin (radians, default 0)
# @input  offset_x         : float item — Additional X offset in profile plane (m, default 0)
# @input  offset_y         : float item — Additional Y offset in profile plane (m, default 0)
# @output out      : str      item — Status message
# @output json_out : str      item — Profile JSON (Profile.to_dict() format)
# @output preview  : geometry item — Profile outline curve in WorldXY
#
# Stateless: creates any supported ifckit profile type and outputs a
# Profile.to_dict() JSON dict consumable by beam/wall/column nodes.

import json

from ifckit.profiles import (
    IBeamProfile, LBeamProfile,
    RectangleProfile, CircleProfile, HollowCircleProfile,
    SteelProfile,
)
from ifckit.rhinokit import path_to_rhino_curve
from ifckit.schema import LengthUnit

_pt = (profile_type or "").strip().lower()
_anchor = (anchor or "c").strip().lower()
_rotation = float(rotation or 0)
_offset_x = float(offset_x or 0)
_offset_y = float(offset_y or 0)
messages = []
json_out = ""
preview = None

try:
    profile = None

    if _pt == "i":
        h  = float(height or 0)
        w  = float(width or 0)
        wt = float(web_thickness or 0)
        ft = float(flange_thickness or 0)
        if h <= 0 or w <= 0 or wt <= 0 or ft <= 0:
            raise ValueError("height, width, web_thickness, flange_thickness all required for I-beam")
        profile = IBeamProfile(
            height=h, width=w, web_thickness=wt, flange_thickness=ft,
            anchor=_anchor, name=name or "I-Profile",
            rotation=_rotation, offset_x=_offset_x, offset_y=_offset_y,
        )

    elif _pt == "l":
        h  = float(height or 0)
        w  = float(width or 0)
        ft = float(flange_thickness or 0)
        if h <= 0 or w <= 0 or ft <= 0:
            raise ValueError("height, width, flange_thickness all required for L-beam")
        profile = LBeamProfile(
            height=h, width=w, thickness=ft,
            anchor=_anchor, name=name or "L-Profile",
            rotation=_rotation, offset_x=_offset_x, offset_y=_offset_y,
        )

    elif _pt == "rect":
        w = float(width or 0)
        h = float(height or 0)
        if w <= 0 or h <= 0:
            raise ValueError("width and height required for rect")
        profile = RectangleProfile(
            x_dim=w, y_dim=h, name=name or "Rect-Profile",
            rotation=_rotation, offset_x=_offset_x, offset_y=_offset_y,
        )

    elif _pt == "circle":
        r = float(radius or 0)
        if r <= 0:
            raise ValueError("radius required for circle")
        profile = CircleProfile(
            radius=r, name=name or "Circle-Profile",
            rotation=_rotation, offset_x=_offset_x, offset_y=_offset_y,
        )

    elif _pt == "hollow_circle":
        r  = float(radius or 0)
        wt = float(wall_thickness or 0)
        if r <= 0 or wt <= 0:
            raise ValueError("radius and wall_thickness required for hollow_circle")
        profile = HollowCircleProfile(
            radius=r, wall_thickness=wt, name=name or "HollowCircle-Profile",
            rotation=_rotation, offset_x=_offset_x, offset_y=_offset_y,
        )

    elif _pt == "steel":
        sname = (steel_name or "").strip()
        if not sname:
            raise ValueError("steel_name required for steel profile")
        u_str = (unit or "m").strip().lower()
        lu = LengthUnit.MILLIMETRE if u_str == "mm" else LengthUnit.METRE
        profile = SteelProfile.from_name(
            sname, anchor=_anchor, unit=lu,
            rotation=_rotation, offset_x=_offset_x, offset_y=_offset_y,
        )
        if name:
            profile.name = name

    else:
        raise ValueError(
            "profile_type must be one of: 'I', 'L', 'rect', 'circle', 'hollow_circle', 'steel'"
        )

    json_out = json.dumps(profile.to_dict())
    preview = path_to_rhino_curve(profile)
    messages.append(f"OK  {profile.name or _pt}")

except Exception as exc:
    messages.append(f"ERR: {exc}")

out = "\n".join(messages) if messages else "No profile processed."
# ---------- end ifckit_profile ----------
ifckit_preview_profile = IfckitPreviewProfile()  # -> out, profile_curve; inputs json_in: String
# ---------- ifckit_preview_profile: Python ----------
#
# gh_preview_profile.py  —  GH Script component: "ifckit Preview Profile"
# =========================================================================
#
# @component  nickname:"ifckit Preview Profile"
# @group "Profiles"
# @input  json_in          : str  item — Profile JSON (json_out from ifckit Profile node)
# @output out              : str  item — Status message
# @output profile_curve    : geometry item — Closed profile curve in WorldXY around origin

from __future__ import annotations

import json
import traceback

# ---------------------------------------------------------------------------
# Reload (development only — harmless in production)
# ---------------------------------------------------------------------------
try:
    from ifckit.rhinokit import reload_all
    reload_all()
except Exception:
    pass

# ---------------------------------------------------------------------------
# Reload (picks up live code changes without restarting Rhino)
# ---------------------------------------------------------------------------
try:
    import os, sys, importlib
    _root = os.environ.get("IFCKIT_PATH", r"/Users/Mauc/L140-py-ifckit")
    if _root not in sys.path:
        sys.path.insert(0, _root)
    import ifckit.rhinokit as _rk
    _rk.reload_all(_root)
except Exception:
    pass

# ---------------------------------------------------------------------------
# Main
# ---------------------------------------------------------------------------
profile_curve = None
out = ""

try:
    if not json_in:
        raise ValueError("json_in is empty")

    d = json.loads(json_in)

    from ifckit.profiles.base import Profile
    from ifckit.rhinokit import profile_to_rhino_curve

    profile = Profile.dispatch_from_dict(d)
    profile_curve = profile_to_rhino_curve(profile)
    out = f"OK: {profile.__class__.__name__}"

except Exception as exc:
    out = f"ERROR: {exc}\n{traceback.format_exc()}"
# ---------- end ifckit_preview_profile ----------

# ----
ifckit_storey_2 = IfckitStorey(
    envelopes=flatten([ifckit_windowtype_2.json_out, ifckit_opening_2.json_out]),
    storey_name="storey",
    elevation=[Slider(0, range=0..10000), Slider(3000, range=0..10000)])  # -> out, flatten(json_out); inputs envelopes: list of String, storey_name: String, elevation: Double; same code as ifckit_storey
ifckit_preview_element_2 = IfckitPreviewElement(json_in=ifckit_storey_2.json_out, skip_voids=Toggle(True))  # -> out, preview; inputs json_in: list of String, unit: String, skip_voids: Boolean
# ---------- ifckit_preview_element_2: Python ----------
#
# gh_preview_element.py  —  GH Script component: "ifckit Preview Element"
# =========================================================================
#
# @component  nickname:"ifckit Preview Element"
# @group "Preview"
# @input  json_in  : str  list — Collector storey JSON(s) or single element JSON(s)
# @input  unit     : str  item — Length unit of coordinates: "MILLIMETRE" (default) or "METRE"
# @output out      : str  item — Status message
# @output preview  : geometry list — Ephemeral meshes (never added to Rhino doc)

from __future__ import annotations

import traceback

# ---------------------------------------------------------------------------
# Reload (development only — harmless in production)
# ---------------------------------------------------------------------------
try:
    from ifckit.rhinokit import reload_all
    reload_all()
except Exception:
    pass

# ---------------------------------------------------------------------------
# Main
# ---------------------------------------------------------------------------
preview = []
out = ""
import json
# Voeg dit toe na build_preview_meshes
from ifckit.json_build import build
from ifckit.preview import _to_project_dict

try:
    from ifckit.preview import build_preview_meshes

    inputs = json_in if isinstance(json_in, list) else [json_in]
    inputs = [s for s in inputs if s]
    _unit = str(unit).upper() if unit else "MILLIMETRE"
    #print(f"Unit: {_unit}")
    #print(f"Input: {inputs[0][:100]}...")
    if not inputs:
        out = "No input"
    else:
        total_meshes = 0
        errors = []

        for s in inputs:
            try:

                #d = json.loads(s)
                #project_dict = _to_project_dict(d, _unit)
                #model = build(project_dict)
                #print(model.to_string())

                meshes = build_preview_meshes(s, unit=_unit, skip_voids=skip_voids)
                preview.extend(meshes)
                total_meshes += len(meshes)

            except Exception as exc:
                errors.append(str(exc))
        print(f"Result: {preview}")
        parts = [f"{total_meshes} mesh(es)"]
        if errors:
            parts.append(f"{len(errors)} error(s): {'; '.join(errors)}")
        out = ", ".join(parts)
        # Na de meshes zijn gemaakt
        
except Exception as exc:
    out = f"ERROR: {exc}\n{traceback.format_exc()}"
# ---------- end ifckit_preview_element_2 ----------

# ---- group: ifckit / Import
ifckit_spaces = IfckitSpaces()  # -> out; inputs ifc_path: String, run: Boolean, layer_root: String, hatch_pattern: String, import_fp: Boolean, import_hatch: Boolean, import_ann: Boolean, import_mesh: Boolean, mesh_quality: String, clear: Boolean
# ---------- ifckit_spaces: Python ----------
#
# gh_spaces.py  —  GH Script component: "ifckit Spaces"
# ======================================================
#
# @component  nickname:"ifckit Spaces"
# @group "Import"
# @input  ifc_path      : str   item — Absolute path to the .ifc file
# @input  run           : bool  item — Set True to import
# @input  layer_root    : str   item — Root layer name (default "IFC-Spaces")
# @input  hatch_pattern : str   item — Rhino hatch pattern for fills (default "Solid")
# @input  import_fp     : bool  item — Draw 2-D footprint curves (default True)
# @input  import_hatch  : bool  item — Draw hatch fills (default True)
# @input  import_ann    : bool  item — Draw TextDot labels (default True)
# @input  import_mesh   : bool  item — Tessellate 3-D bodies (default False)
# @input  mesh_quality  : str   item — Tessellation quality preset (default "default")
# @input  clear         : bool  item — Clear existing objects first (default True)
# @output out : str item — Status message
#
# Reads IfcSpace entities from an IFC file and draws footprint curves,
# hatches, annotations and/or 3-D mesh bodies in the active Rhino document.

from ifckit.rhino_import import IfcSpaceImporter

import scriptcontext as sc

# ---------------------------------------------------------------------------
# Resolve inputs
# ---------------------------------------------------------------------------
_ifc_path      = ifc_path      if ifc_path      else ""
_layer_root    = layer_root    if layer_root    else "IFC-Spaces"
_hatch_pattern = hatch_pattern if hatch_pattern else "Solid"
_import_fp     = import_fp     if import_fp  is not None else True
_import_hatch  = import_hatch  if import_hatch is not None else True
_import_ann    = import_ann    if import_ann  is not None else True
_import_mesh   = import_mesh   if import_mesh is not None else False
_mesh_quality  = mesh_quality  if mesh_quality else "default"
_clear         = clear         if clear is not None else True

out = ""

# ---------------------------------------------------------------------------
# Guards
# ---------------------------------------------------------------------------
if not _ifc_path:
    out = "Set ifc_path to the absolute path of the IFC file."

elif not run:
    out = (
        f"IFC file: {_ifc_path}\n"
        f"Layer root: {_layer_root!r}\n"
        f"Import: footprint={_import_fp}, hatch={_import_hatch}, "
        f"annotation={_import_ann}, mesh={_import_mesh}\n"
        "Set run=True to import."
    )

else:
    try:
        importer = IfcSpaceImporter(
            layer_root=_layer_root,
            hatch_pattern=_hatch_pattern,
            import_footprint=_import_fp,
            import_hatch=_import_hatch,
            import_annotation=_import_ann,
            import_mesh=_import_mesh,
            mesh_quality=_mesh_quality,
        )

        if _clear:
            removed = importer.clear()
            clear_msg = f"Cleared {removed} existing objects."
        else:
            clear_msg = ""

        result = importer.import_file(_ifc_path)

        lines = [
            f"Spaces:      {result['spaces']}",
            f"Footprints:  {result['footprints']}",
            f"Hatches:     {result['hatches']}",
            f"Annotations: {result['annotations']}",
            f"Meshes:      {result['meshes']}",
        ]
        if clear_msg:
            lines.append(clear_msg)
        out = "\n".join(lines)

    except Exception as exc:
        import traceback
        out = f"FAILED: {exc}\n{traceback.format_exc()}"

print(out)
# ---------- end ifckit_spaces ----------

# ----
relative_path = Python3Script(name="hello_wall")  # -> out, a
# ---------- relative_path: Python ----------
from pathlib import Path
myname = "output/{}.ifc".format(name)
p = Path(ghenv.Component.OnPingDocument().FilePath).parent
 
if name:
    a = str(p / myname)
else:
    a = str(p)

print(a)
# ---------- end relative_path ----------
ifckit_build_json_2 = IfckitBuildJSON(storeys=ifckit_storey_2.json_out)  # -> out, flatten(json_out); inputs storeys: list of String, project_name: String, author: String, unit: String, ifc_version: String; same code as ifckit_build_json
panel = Panel(ifckit_build_json_2.json_out)
ifckit_export_ifc_2 = IfckitExportIFC(
    json_input=ifckit_build_json_2.json_out,
    ifc_output=relative_path.a,
    run_export=Toggle(True),
    run_preview=Toggle(True),
    skip_voids=Toggle(True))  # -> out, model_ready; inputs json_input: String, ifc_output: String, run_export: Boolean, run_preview: Boolean, mesh_quality: String, sticky_key: String, skip_voids: Boolean
# ---------- ifckit_export_ifc_2: Python ----------
#
# gh_export_json.py  —  GH Script component: "ifckit Export IFC"
# ===============================================================
#
# @component  nickname:"ifckit Export IFC"
# @group "Export"
# @input  json_input   : str  item — Full IFC project JSON from Build JSON node
# @input  ifc_output   : str  item — Absolute path for the output .ifc file (optional)
# @input  run_export   : bool item — Set True to write the IFC file
# @input  run_preview  : bool item — Set True to import meshes into Rhino
# @input  mesh_quality : str  item — Preview tessellation quality (default "default")
# @input  sticky_key   : str  item — sc.sticky key (default "ifckit_model")
# @output out         : str item — Status message
# @output model_ready : int item — Increments on every successful build
#
# Builds an IFC model from JSON, optionally exports to file and/or previews
# meshes in Rhino, and stores the model in sc.sticky for downstream drawing nodes.

import json
from ifckit import rhinokit as rk
rk.reload_all()
from ifckit.json_build import build

import scriptcontext as sc

_quality    = mesh_quality if mesh_quality else "default"
_sticky_key = sticky_key   if sticky_key   else "ifckit_model"
_ver_key    = _sticky_key + "_version"
_skip_voids = skip_voids if skip_voids else False

out         = ""
model_ready = sc.sticky.get(_ver_key, 0)  # expose current version even when idle

if not json_input:
    out = "ERROR: no JSON input."
elif not run_export and not run_preview:
    try:
        data = json.loads(json_input)
        total = sum(
            len(s.get("elements", []))
            for b in data.get("buildings", [])
            for s in b.get("storeys", [])
        )
        lines = [f"Model has {total} elements."]
        if ifc_output:
            lines.append(f"Set run_export=True to export to:\n  {ifc_output}")
        lines.append("Set run_preview=True to preview in Rhino.")
        out = "\n".join(lines)
    except json.JSONDecodeError as exc:
        out = f"ERROR: Invalid JSON: {exc}"
else:
    try:
        data  = json.loads(json_input)
        model = build(data)
        messages = []

        if run_export:
            if not ifc_output:
                messages.append("EXPORT SKIPPED: ifc_output is empty.")
            else:
                model.save(ifc_output)
                messages.append(f"Exported to:\n  {ifc_output}")

        if run_preview:
            messages.append("======================================================================")
            messages.append(model.to_string())
            messages.append("======================================================================")
            count = model.preview_rhino(mesh_quality=_quality, skip_voids=_skip_voids)
            messages.append(f"Previewing {count} elements in Rhino.")

        # Store model in sticky for drawing nodes.
        sc.sticky[_sticky_key] = model
        sc.sticky[_ver_key]    = sc.sticky.get(_ver_key, 0) + 1
        model_ready            = sc.sticky[_ver_key]
        messages.append(f"Model stored (version {model_ready}).")

        out = "\n".join(messages)

    except Exception as exc:
        import traceback
        messages.append(f"FAILED: {exc}\n{traceback.format_exc()}")

print(out)
# ---------- end ifckit_export_ifc_2 ----------
panel_2 = Panel(ifckit_export_ifc_2.out)
