# Grasshopper definition ifckit-components.gh (Grasshopper 1.0.8)
# plug-ins: Mauc

# ---- group: p0
vec = VectorXYZ(XComponent=Slider(0, range=0..10000), YComponent=Slider(0, range=0..10000), ZComponent=Slider(3000, range=0..10000))  # -> Vector, Length

# ----
number_slider = Slider(300, range=0..1000)
number_slider_2 = Slider(10, range=0..10)

vec_2 = VectorXYZ(XComponent=Slider(0, range=0..10000), YComponent=Slider(0, range=0..10000), ZComponent=Slider(0, range=0..10000))  # -> Vector, Length
move = Move(Geometry=vec.Vector, Motion=vec_2.Vector)  # -> Geometry, Transform

vec_3 = VectorXYZ(XComponent=Slider(9000, range=0..10000), YComponent=Slider(0, range=0..10000), ZComponent=Slider(0, range=0..10000))  # -> Vector, Length
move_2 = Move(Geometry=move.Geometry, Motion=vec_3.Vector)  # -> Geometry, Transform

# ---- group: p1
vec_4 = VectorXYZ(XComponent=Slider(10000, range=0..10000), YComponent=Slider(0, range=0..10000), ZComponent=Slider(0, range=0..10000))  # -> Vector, Length
move_3 = Move(Geometry=move.Geometry, Motion=vec_4.Vector)  # -> Geometry, Transform

# ----
vec_5 = VectorXYZ(XComponent=Slider(1000, range=0..10000), YComponent=Slider(0, range=0..10000), ZComponent=Slider(0, range=0..10000))  # -> Vector, Length
move_4 = Move(Geometry=move.Geometry, Motion=vec_5.Vector)  # -> Geometry, Transform

vec_6 = VectorXYZ(XComponent=Slider(5000, range=0..10000), YComponent=Slider(0, range=0..10000), ZComponent=Slider(1597, range=0..10000))  # -> Vector, Length
move_5 = Move(Geometry=move.Geometry, Motion=vec_6.Vector)  # -> Geometry, Transform

rad = Radians(Degrees=Slider(0, range=0..100))
pt = Point([move.Geometry, move_4.Geometry, move_5.Geometry, move_2.Geometry, move_3.Geometry])
ifckit_profile = IfckitProfile(
    profile_type="steel",
    height=number_slider,
    width=number_slider,
    web_thickness=number_slider_2,
    flange_thickness=number_slider_2,
    steel_name="IPE300",
    unit="mm",
    anchor="s",
    rotate=rad,
    offset_x=Slider(16, range=0..100))  # -> out, preview, json_out; inputs profile_type: String, height: Double, width: Double, web_thickness: Double, flange_thickness: Double, radius: Double, wall_thickness: Double, steel_name: String, unit: String, name: String, anchor: String, rotate: Double, offset_x: Double, offset_y: Double
# ---------- ifckit_profile: Python ----------
import json
import ifckit
from ifckit import rhinokit as rk
rk.reload_all()
from ifckit.profiles import (
    IBeamProfile, LBeamProfile,
    RectangleProfile, CircleProfile, HollowCircleProfile,
    SteelProfile,
)
from ifckit.schema import LengthUnit

_pt = (profile_type or "").strip().lower()
_rotate = rotate if rotate else 0
_offset_x = offset_x if offset_x else 0
_offset_y = offset_y if offset_y else 0

messages = []
json_out = ""

try:
    profile = None

    if _pt == "i":
        h  = float(height or 0)
        w  = float(width or 0)
        wt = float(web_thickness or 0)
        ft = float(flange_thickness or 0)
        if h <= 0 or w <= 0 or wt <= 0 or ft <= 0:
            raise ValueError("height, width, web_thickness, flange_thickness all required for I-beam")
        profile = IBeamProfile(height=h, width=w, web_thickness=wt, flange_thickness=ft, name=name or "I-Profile")
        profile.anchor = anchor
    elif _pt == "l":
        h  = float(height or 0)
        w  = float(width or 0)
        ft = float(flange_thickness or 0)
        if h <= 0 or w <= 0 or ft <= 0:
            raise ValueError("height, width, flange_thickness all required for L-beam")
        profile = LBeamProfile(height=h, width=w, flange_thickness=ft, name=name or "L-Profile")
        profile.anchor = anchor
    elif _pt == "rect":
        w = float(width or 0)
        h = float(height or 0)
        if w <= 0 or h <= 0:
            raise ValueError("width and height required for rect")
        profile = RectangleProfile(width=w, height=h, name=name or "Rect-Profile")

    elif _pt == "circle":
        r = float(radius or 0)
        if r <= 0:
            raise ValueError("radius required for circle")
        profile = CircleProfile(radius=r, name=name or "Circle-Profile")

    elif _pt == "hollow_circle":
        r  = float(radius or 0)
        wt = float(wall_thickness or 0)
        if r <= 0 or wt <= 0:
            raise ValueError("radius and wall_thickness required for hollow_circle")
        profile = HollowCircleProfile(radius=r, wall_thickness=wt, name=name or "HollowCircle-Profile")

    elif _pt == "steel":
        sname = (steel_name or "").strip()
        if not sname:
            raise ValueError("steel_name required for steel profile")
        u_str = (unit or "m").strip().lower()
        lu = LengthUnit.MILLIMETRE if u_str == "mm" else LengthUnit.METRE
        profile = SteelProfile.from_name(sname, unit=lu)
        profile.anchor = anchor
        if name:
            profile.name = name

    else:
        raise ValueError(
            "profile_type must be one of: 'I', 'L', 'rect', 'circle', 'hollow_circle', 'steel'"
        )
    profile.rotation = _rotate
    profile.offset_x = _offset_x
    profile.offset_y = _offset_y
    preview = rk.profile_to_rhino_curve(profile)
    json_out = json.dumps(profile.to_dict())
    messages.append(f"OK  {profile.name or _pt}")

except Exception as exc:
    messages.append(f"ERR: {exc}")

out = "\n".join(messages) if messages else "No profile processed."
# ---------- end ifckit_profile ----------
vec_7 = VectorXYZ(XComponent=Slider(1000, range=0..1000), YComponent=0, ZComponent=0)  # -> Vector, Length
nurbs = NurbsCurve(Vertices=pt, Degree=3, Periodic=False)  # -> Curve, Length, Domain
vec_8 = VectorXYZ(XComponent=0, YComponent=0, ZComponent=0)  # -> Vector, Length
move_6 = Move(Geometry=vec_8.Vector, Motion=vec_7.Vector)  # -> Geometry, Transform
ln = Line(StartPoint=vec_8.Vector, EndPoint=move_6.Geometry)
panel = Panel(ifckit_profile.json_out)
ifckit_beam = IfckitBeam(line_curve=ln, profile_json=ifckit_profile.json_out)  # -> out, json_out; inputs line_curve: Line, profile_pts: list of Point3d, profile_json: String, name: String
# ---------- ifckit_beam: Python ----------
import json

from ifckit import PendingBeam, Vec
from ifckit.profiles import Profile
import ifckit.rhinokit as rk
from ifckit.builders.beam_factory import PathType, classify_path
rk.reload_all()

def _get_profile():
    """Get profile from profile_json (Profile.to_dict() format) or profile_pts."""
    if profile_json:
        try:
            data = json.loads(profile_json)
            if "profile_type" in data:
                return Profile.dispatch_from_dict(data)
        except Exception:
            pass

    if profile_pts:
        return rk.pts_to_vecs(profile_pts)

    return None


messages = []
json_outputs = []

if line_curve:
    line = rk.line_to_line(line_curve)
    if not line:
        messages.append("ERR: invalid line curve")
    else:
        prof = _get_profile()
        if not prof:
            messages.append("ERR: no profile (provide profile_pts or profile_json)")
        else:
            path_type = classify_path(line)
            if path_type != PathType.SINGLE_LINE:
                messages.append(f"ERR: expected single line path, got {path_type}")
            else:
                try:
                    el_name = name or "Beam"
                    beam = PendingBeam(axis=line, profile=prof, name=el_name)
                    json_outputs.append(beam.to_json())
                    messages.append(f"OK  {el_name}")
                except Exception as exc:
                    messages.append(f"ERR {el_name}: {exc}")

elif not line_curve:
    messages.append("No line curve")

out = "\n".join(messages) if messages else "No beams processed."
print(out)
json_out = json_outputs if json_outputs else []
# ---------- end ifckit_beam ----------
test_beam = Text(ifckit_beam.json_out)
panel_2 = Panel(ifckit_beam.json_out)
p0 = Point(move.Geometry)

vec_9 = VectorXYZ(XComponent=0, YComponent=Slider(1000, range=0..10000), ZComponent=Slider(0, range=0..10000))  # -> Vector, Length
move_7 = Move(Geometry=p0, Motion=vec_9.Vector)  # -> Geometry, Transform

vec_10 = VectorXYZ(XComponent=0, YComponent=Slider(4260, range=0..10000), ZComponent=Slider(814, range=0..10000))  # -> Vector, Length
move_8 = Move(Geometry=p0, Motion=vec_10.Vector)  # -> Geometry, Transform

# ---- group: ifckit / Export
ifckit_build_json = IfckitBuildJSON()  # -> out, json_out; inputs json_input: list of String, project_name: String, author: String, unit: String, ifc_version: String
# ---------- ifckit_build_json: Python ----------
#
# gh_build_json.py  —  GH Script component: "ifckit Build JSON"
# ==============================================================
#
# @component  nickname:"ifckit Build JSON"
# @group "Export"
# @input  json_input   : str  list — JSON strings from element nodes
# @input  project_name : str  item — IFC project name (default "GH Project")
# @input  author       : str  item — Author string (default "GH")
# @input  unit         : str  item — "METRE" or "MILLIMETRE" (default "MILLIMETRE")
# @input  ifc_version  : str  item — "IFC2X3" or "IFC4" (default "IFC2X3")
# @output out      : str item — Status message
# @output json_out : str item — Full IFC project JSON for Export node
#
# Stateless: merges element JSON strings into a full IFC project JSON.

import json

out = ""
json_out = ""

if not json_input:
    out = "ERROR: no JSON input."
else:
    try:
        _project_name = str(project_name) if project_name else "GH Project"
        _author = str(author) if author else "GH"
        _unit = str(unit).upper() if unit else "MILLIMETRE"
        _ifc_version = str(ifc_version).upper() if ifc_version else "IFC2X3"

        inputs = json_input if isinstance(json_input, list) else [json_input]

        storeys_out = []
        total = 0

        for item in inputs:
            s = str(item).strip()
            if not s:
                continue
            storey = json.loads(s)
            sname = storey.get("storey_name", "Default")
            elev = float(storey.get("elevation", 0.0))
            elems = storey.get("elements", [])
            parsed = [json.loads(e) if isinstance(e, str) else e for e in elems]
            storeys_out.append(
                {
                    "name": sname,
                    "elevation": elev,
                    "elements": parsed,
                }
            )
            total += len(parsed)

        project_json = {
            "ifc_version": _ifc_version,
            "project": {"name": _project_name, "author": _author},
            "unit": _unit,
            "site": {"name": "Site"},
            "buildings": [{"name": "Building", "storeys": storeys_out}],
        }

        out = "Built project JSON: {} elements across {} storey(s).".format(
            total, len(storeys_out)
        )
        json_out = json.dumps(project_json, separators=(",", ":"))

    except Exception as exc:
        out = "FAILED: {}".format(exc)

print(out)
# ---------- end ifckit_build_json ----------
ifckit_export_ifc = IfckitExportIFC()  # -> out, model_ready; inputs json_input: String, ifc_output: String, run_export: Boolean, run_preview: Boolean, mesh_quality: String, sticky_key: String
# ---------- ifckit_export_ifc: Python ----------
#
# gh_export_json.py  —  GH Script component: "ifckit Export IFC"
# ===============================================================
#
# @component  nickname:"ifckit Export IFC"
# @group "Export"
# @input  json_input   : str  item — Full IFC project JSON from Build JSON node
# @input  ifc_output   : str  item — Absolute path for the output .ifc file (optional)
# @input  run_export   : bool item — Set True to write the IFC file
# @input  run_preview  : bool item — Set True to import meshes into Rhino
# @input  mesh_quality : str  item — Preview tessellation quality (default "default")
# @input  sticky_key   : str  item — sc.sticky key (default "ifckit_model")
# @output out         : str item — Status message
# @output model_ready : int item — Increments on every successful build
#
# Builds an IFC model from JSON, optionally exports to file and/or previews
# meshes in Rhino, and stores the model in sc.sticky for downstream drawing nodes.

import json

from ifckit.json_build import build

import scriptcontext as sc

_quality    = mesh_quality if mesh_quality else "default"
_sticky_key = sticky_key   if sticky_key   else "ifckit_model"
_ver_key    = _sticky_key + "_version"

out         = ""
model_ready = sc.sticky.get(_ver_key, 0)  # expose current version even when idle

if not json_input:
    out = "ERROR: no JSON input."
elif not run_export and not run_preview:
    try:
        data = json.loads(json_input)
        total = sum(
            len(s.get("elements", []))
            for b in data.get("buildings", [])
            for s in b.get("storeys", [])
        )
        lines = [f"Model has {total} elements."]
        if ifc_output:
            lines.append(f"Set run_export=True to export to:\n  {ifc_output}")
        lines.append("Set run_preview=True to preview in Rhino.")
        out = "\n".join(lines)
    except json.JSONDecodeError as exc:
        out = f"ERROR: Invalid JSON: {exc}"
else:
    try:
        data  = json.loads(json_input)
        model = build(data)
        messages = []

        if run_export:
            if not ifc_output:
                messages.append("EXPORT SKIPPED: ifc_output is empty.")
            else:
                model.save(ifc_output)
                messages.append(f"Exported to:\n  {ifc_output}")

        if run_preview:
            count = model.preview_rhino(mesh_quality=_quality)
            messages.append(f"Previewing {count} elements in Rhino.")

        # Store model in sticky for drawing nodes.
        sc.sticky[_sticky_key] = model
        sc.sticky[_ver_key]    = sc.sticky.get(_ver_key, 0) + 1
        model_ready            = sc.sticky[_ver_key]
        messages.append(f"Model stored (version {model_ready}).")

        out = "\n".join(messages)

    except Exception as exc:
        import traceback
        out = f"FAILED: {exc}\n{traceback.format_exc()}"

print(out)
# ---------- end ifckit_export_ifc ----------

# ---- group: ifckit / Elements
ifckit_beam_2 = IfckitBeam()  # -> out, json_out; inputs line_curve: Curve, profile_pts: list of Point3d, profile_json: String, name: String, properties: String
# ---------- ifckit_beam_2: Python ----------
#
# gh_create_beam.py  —  GH Script component: "ifckit Beam"
# =========================================================
#
# @component  nickname:"ifckit Beam"
# @group "Elements"
# @input  line_curve   : curve item — LineCurve defining the beam axis
# @input  profile_pts  : point list — Cross-section polygon as Point3d list (fallback)
# @input  profile_json : str   item — Profile JSON from ifckit Profile node
# @input  name         : str   item — Optional element name
# @input  properties   : str   item — JSON dict of user properties e.g. {"Supplier": "Voortman"}
# @output out      : str item — Status message
# @output json_out : str  list — List of element JSON strings
#
# Stateless: serializes linear beam paths → IfcExtrudedAreaSolid via PendingBeam.

import json

from ifckit import PendingBeam, Vec
from ifckit.profiles import Profile
import ifckit.rhinokit as rk
from ifckit.builders.beam_factory import PathType, classify_path


def _get_profile():
    """Get profile from profile_json (Profile.to_dict() format) or profile_pts."""
    if profile_json:
        try:
            data = json.loads(profile_json)
            if "profile_type" in data:
                return Profile.dispatch_from_dict(data)
        except Exception:
            pass

    if profile_pts:
        return rk.pts_to_vecs(profile_pts)

    return None


def _get_properties():
    if properties:
        try:
            return json.loads(properties)
        except Exception:
            pass
    return {}


messages = []
json_outputs = []

if line_curve:
    line = rk.curves_to_path(line_curve)
    if not line:
        messages.append("ERR: invalid line curve")
    else:
        prof = _get_profile()
        if not prof:
            messages.append("ERR: no profile (provide profile_pts or profile_json)")
        else:
            path_type = classify_path(line)
            if path_type != PathType.SINGLE_LINE:
                messages.append(f"ERR: expected single line path, got {path_type}")
            else:
                try:
                    el_name = name or "Beam"
                    beam = PendingBeam(axis=line, profile=prof, name=el_name,
                                      properties=_get_properties())
                    json_outputs.append(beam.to_json())
                    messages.append(f"OK  {el_name}")
                except Exception as exc:
                    messages.append(f"ERR {el_name}: {exc}")

elif not line_curve:
    messages.append("No line curve")

out = "\n".join(messages) if messages else "No beams processed."
print(out)
json_out = json_outputs if json_outputs else []
# ---------- end ifckit_beam_2 ----------
ifckit_beam_any_path = IfckitBeamAnyPath()  # -> out, path_type, json_out; inputs path_curve: Curve, profile_pts: list of Point3d, profile_json: String, name: String, properties: String
# ---------- ifckit_beam_any_path: Python ----------
#
# gh_create_beam_any.py  —  GH Script component: "ifckit Beam (Any Path)"
# ========================================================================
#
# @component  nickname:"ifckit Beam (Any Path)"
# @group "Elements"
# @input  path_curve   : curve   item — LineCurve or ArcCurve defining the beam path
# @input  profile_pts  : point   list — Cross-section polygon as Point3d list (fallback)
# @input  profile_json : str     item — Profile JSON from ifckit Profile node
# @input  name         : str     item — Optional element name
# @input  properties   : str     item — JSON dict of user properties e.g. {"Supplier": "Voortman"}
# @output out       : str     item — Status message
# @output path_type : str     item — Detected path type
# @output json_out  : str     list — List of element JSON strings
#
# Stateless: auto-detects path type (line → ExtrudedAreaSolid, arc → RevolvedAreaSolid).

import math
import json

from ifckit import PendingBeam, PendingRevolvedBeam, Vec
from ifckit.profiles import Profile
import ifckit.rhinokit as rk
from ifckit.builders.beam_factory import PathType, classify_path


def _get_profile():
    """Get profile from profile_json (Profile.to_dict() format) or profile_pts."""
    if profile_json:
        try:
            data = json.loads(profile_json)
            if "profile_type" in data:
                return Profile.dispatch_from_dict(data)
        except Exception:
            pass

    if profile_pts:
        return rk.pts_to_vecs(profile_pts)

    return None


def _get_properties():
    if properties:
        try:
            return json.loads(properties)
        except Exception:
            pass
    return {}


messages = []
json_outputs = []

if path_curve:
    line = rk.curves_to_path(path_curve)
    if line:
        path = line
        detected_path_type = classify_path(path)
    else:
        arc = rk.arc_to_arc(path_curve)
        if arc:
            path = arc
            detected_path_type = classify_path(path)
        else:
            messages.append("ERR: invalid curve (not line or arc)")
            detected_path_type = "unknown"

    if detected_path_type in (PathType.SINGLE_LINE, PathType.SINGLE_ARC):
        prof = _get_profile()
        if not prof:
            messages.append("ERR: no profile (provide profile_pts or profile_json)")
        else:
            try:
                el_name = name or "Beam"

                if detected_path_type == PathType.SINGLE_LINE:
                    beam = PendingBeam(axis=path, profile=prof, name=el_name,
                                      properties=_get_properties())
                    solid_type = "ExtrudedAreaSolid"
                else:
                    beam = PendingRevolvedBeam(arc=path, profile=prof, name=el_name,
                                              properties=_get_properties())
                    solid_type = "RevolvedAreaSolid"
                    angle_deg = math.degrees(abs(path.angle))

                json_outputs.append(beam.to_json())
                if detected_path_type == PathType.SINGLE_LINE:
                    messages.append(f"OK  {el_name} ({solid_type})")
                else:
                    messages.append(f"OK  {el_name} ({solid_type}, {angle_deg:.0f}° arc)")
            except Exception as exc:
                messages.append(f"ERR {el_name}: {exc}")
    elif detected_path_type == PathType.MULTI_SEGMENT:
        messages.append("ERR: multi-segment path not yet implemented")
    elif detected_path_type == PathType.NON_PLANAR:
        messages.append("ERR: non-planar path not yet implemented")
    else:
        if not messages:
            messages.append("ERR: could not classify path")

elif not path_curve:
    messages.append("No path curve")

out = "\n".join(messages) if messages else "No beams processed."
print(out)
path_type = detected_path_type if 'detected_path_type' in dir() else ""
json_out = json_outputs if json_outputs else []
# ---------- end ifckit_beam_any_path ----------
ifckit_wall = IfckitWall()  # -> out, json_out; inputs base_curve: Curve, height: Double, thickness: Double, name: String, properties: String
# ---------- ifckit_wall: Python ----------
#
# gh_create_wall.py  —  GH Script component: "ifckit Wall"
# =========================================================
#
# @component  nickname:"ifckit Wall"
# @group "Elements"
# @input  base_curve : curve item — Base line curve of the wall
# @input  height     : float item — Wall height (m)
# @input  thickness  : float item — Wall thickness (m)
# @input  name       : str   item — Optional element name
# @input  properties : str   item — JSON dict of user properties e.g. {"Material": "Concrete"}
# @output out      : str item — Status message
# @output json_out : str  list — List of element JSON strings
#
# Stateless: serializes wall curves → JSON strings.

import json
from ifckit import PendingWall, Plane, rhinokit as rk


def _get_properties():
    if properties:
        try:
            return json.loads(properties)
        except Exception:
            pass
    return {}


messages = []
json_outputs = []

if base_curve:
    curves = base_curve if hasattr(base_curve, "__iter__") else [base_curve]

    for i, crv in enumerate(curves):
        if crv is None:
            continue
        el_name = f"{name or 'Wall'}-{i + 1}"
        footprint = rk.polyline_to_vecs(crv)
        wall = PendingWall(
            footprint=footprint,
            plane=Plane.world_xy(),
            height=float(height),
            name=el_name,
            properties=_get_properties(),
        )
        json_outputs.append(wall.to_json())
        messages.append(f"OK  {el_name}")

out = "\n".join(messages) if messages else "No walls processed."
json_out = json_outputs if json_outputs else []
# ---------- end ifckit_wall ----------

# ---- group: ifckit / Drawing
ifckit_drawing = IfckitDrawing()  # -> out; inputs model_ready: Int32, drawing_name: String, run: Boolean, hlr_poly: Boolean, mesher_defl: Double, hatch_pattern: String, clear: Boolean, sticky_key: String, dest_plane: Plane
# ---------- ifckit_drawing: Python ----------
#
# gh_drawing.py  —  GH Script component: "ifckit Drawing"
# ========================================================
#
# @component  nickname:"ifckit Drawing"
# @group "Drawing"
# @input  model_ready   : int   item — From Export node; confirms model version
# @input  drawing_name  : str   item — Name of the IfcAnnotation drawing to generate
# @input  run           : bool  item — Set True to generate
# @input  hlr_poly      : bool  item — Use polygonal HLR (default True)
# @input  mesher_defl   : float item — OCC mesher linear deflection in metres (optional)
# @input  hatch_pattern : str   item — Fallback hatch pattern (default "Solid")
# @input  clear         : bool  item — Remove existing curves/hatches first (default True)
# @input  sticky_key    : str   item — sc.sticky key to read model from (default "ifckit_model")
# @input  dest_plane    : plane item — Rhino Plane for drawing placement (optional)
# @output out : str item — Status message
#
# Imports one named IFC drawing (section plane + projection) into the active
# Rhino document as curves and hatches.

from ifckit.rhino_import import IfcSvgImporter

import scriptcontext as sc

# ---------------------------------------------------------------------------
# Resolve inputs
# ---------------------------------------------------------------------------
_sticky_key    = sticky_key    if sticky_key    else "ifckit_model"
_drawing_name  = drawing_name  if drawing_name  else ""
_hlr_poly      = hlr_poly      if hlr_poly is not None else True
_mesher_defl   = float(mesher_defl) if mesher_defl else None
_hatch_pattern = hatch_pattern if hatch_pattern else "Solid"
_clear         = clear         if clear is not None else True
_model_ready   = model_ready   if model_ready is not None else 0

# Destination plane — None means keep drawing on section plane.
_dest_plane = dest_plane if dest_plane is not None else None

out = ""

# ---------------------------------------------------------------------------
# Guards
# ---------------------------------------------------------------------------
if not _drawing_name:
    out = "Set drawing_name to the exact name of the drawing to generate."

elif not run:
    model = sc.sticky.get(_sticky_key)
    if model is None:
        out = (
            f"No model in sc.sticky[{_sticky_key!r}].\n"
            "Run the Export node first, then set run=True here."
        )
    else:
        lines = [
            f"Model ready (version {_model_ready}).",
            f"Drawing: {_drawing_name!r}",
        ]
        if _dest_plane is not None:
            lines.append(f"Destination plane: {_dest_plane.Origin}")
        lines.append("Set run=True to generate.")
        out = "\n".join(lines)

else:
    # -----------------------------------------------------------------------
    # Generate
    # -----------------------------------------------------------------------
    model = sc.sticky.get(_sticky_key)

    if model is None:
        out = (
            f"ERROR: no model found in sc.sticky[{_sticky_key!r}].\n"
            "Run the Export node first."
        )
    else:
        try:
            importer = IfcSvgImporter(hatch_pattern=_hatch_pattern)

            if _clear:
                removed = importer.clear_drawing(_drawing_name)
                clear_msg = f"Cleared {removed} existing objects."
            else:
                clear_msg = ""

            result = importer.import_model(
                model,
                hlr_poly=_hlr_poly,
                mesher_deflection=_mesher_defl,
                drawing_filter=_drawing_name,
                destination_plane=_dest_plane,
            )

            lines = [
                f"Drawing:  {_drawing_name!r}",
                f"Curves:   {result['curves']}",
                f"Hatches:  {result['hatches']}",
            ]
            if _dest_plane is not None:
                lines.append(f"Placed on destination plane: {_dest_plane.Origin}")
            if clear_msg:
                lines.append(clear_msg)
            out = "\n".join(lines)

        except Exception as exc:
            import traceback
            out = f"FAILED: {exc}\n{traceback.format_exc()}"

print(out)
# ---------- end ifckit_drawing ----------
ifckit_svg_curves = IfckitSVGCurves()  # -> out; inputs json_input: String, project_name: String, author: String, unit: String, run: Boolean, ifc_path: String, hlr_poly: Boolean, mesher_defl: Double
# ---------- ifckit_svg_curves: Python ----------
#
# gh_svg_curves.py  —  GH Script component: "ifckit SVG Curves"
# ==============================================================
#
# @component  nickname:"ifckit SVG Curves"
# @group "Drawing"
# @input  json_input   : str   item — JSON string from Build JSON node (or leave empty)
# @input  project_name : str   item — IFC project name (default "GH Project")
# @input  author       : str   item — Author (default "GH")
# @input  unit         : str   item — "METRE" or "MILLIMETRE" (default "MILLIMETRE")
# @input  run          : bool  item — Set True to execute
# @input  ifc_path     : str   item — Path to existing .ifc (overrides json_input)
# @input  hlr_poly     : bool  item — Use polygonal HLR (default True)
# @input  mesher_defl  : float item — OCC mesher deflection in metres (optional)
# @output out : str item — Status message
#
# Generates 2-D section drawings from an IFC model via ifcopenshell.draw,
# parses the SVG and places curves + hatches on structured Rhino layers.

# ---------------------------------------------------------------------------
# Resolve inputs with sensible defaults
# ---------------------------------------------------------------------------
import json

_project_name  = project_name   if project_name   else "GH Project"
_author        = author         if author         else "GH"
_unit          = unit.upper()   if unit           else "MILLIMETRE"
_ifc_path      = ifc_path       if ifc_path       else ""
_hlr_poly      = hlr_poly       if hlr_poly is not None else True
_mesher_defl   = float(mesher_defl) if mesher_defl else None

out = ""

if not run:
    out = "Set run=True to import SVG curves into Rhino."

elif _ifc_path:
    # -----------------------------------------------------------------------
    # Direct IFC file import — bypass JSON build
    # -----------------------------------------------------------------------
    try:
        from ifckit.rhino_import import IfcSvgImporter

        importer = IfcSvgImporter()
        importer.clear()
        result = importer.import_file(
            _ifc_path,
            hlr_poly=_hlr_poly,
            mesher_deflection=_mesher_defl,
        )
        out = (
            f"Imported from file:\n  {_ifc_path}\n"
            f"Curves:  {result['curves']}\n"
            f"Hatches: {result['hatches']}"
        )
    except Exception as exc:
        import traceback
        out = f"FAILED: {exc}\n{traceback.format_exc()}"

elif json_input:
    # -----------------------------------------------------------------------
    # Build IFC from JSON then import
    # -----------------------------------------------------------------------
    try:
        from ifckit.json_build import build

        data = json.loads(json_input)

        project_json = {
            "ifc_version": "IFC4",
            "project": {"name": _project_name, "author": _author},
            "unit": _unit,
            "site": {"name": "Site"},
            "buildings": [
                {
                    "name": "Building",
                    "storeys": [
                        {
                            "name": storey_name,
                            "elevation": 0.0,
                            "elements": [
                                json.loads(elem_json)
                                if isinstance(elem_json, str)
                                else elem_json
                                for elem_json in elements
                            ],
                        }
                        for storey_name, elements in data.get("storeys", {}).items()
                    ],
                }
            ],
        }

        model = build(project_json)
        result = model.preview_rhino_curves(
            clear=True,
            hlr_poly=_hlr_poly,
            mesher_deflection=_mesher_defl,
        )
        out = (
            f"Curves:  {result['curves']}\n"
            f"Hatches: {result['hatches']}"
        )

    except Exception as exc:
        import traceback
        out = f"FAILED: {exc}\n{traceback.format_exc()}"

else:
    out = "ERROR: provide json_input or ifc_path."

print(out)
# ---------- end ifckit_svg_curves ----------

# ---- group: ifckit / Preview
ifckit_preview_element = IfckitPreviewElement()  # -> out, preview; inputs json_in: list of String
# ---------- ifckit_preview_element: Python ----------
#
# gh_preview_element.py  —  GH Script component: "ifckit Preview Element"
# =========================================================================
#
# @component  nickname:"ifckit Preview Element"
# @group "Preview"
# @input  json_in  : str  list — Collector storey JSON(s) or single element JSON(s)
# @output out      : str  item — Status message
# @output preview  : geometry list — Ephemeral meshes (never added to Rhino doc)

from __future__ import annotations

import traceback

# ---------------------------------------------------------------------------
# Reload helper (development only — harmless in production)
# ---------------------------------------------------------------------------
try:
    import ifckit.preview  # noqa: F401
    from ifckit.rhinokit import reload_all

    reload_all(__file__)
except Exception:
    pass

# ---------------------------------------------------------------------------
# Main
# ---------------------------------------------------------------------------
preview = []
out = ""

try:
    from ifckit.preview import build_preview_meshes

    inputs = json_in if isinstance(json_in, list) else [json_in]
    inputs = [s for s in inputs if s]

    if not inputs:
        out = "No input"
    else:
        total_meshes = 0
        errors = []

        for s in inputs:
            try:
                meshes = build_preview_meshes(s)
                preview.extend(meshes)
                total_meshes += len(meshes)
            except Exception as exc:
                errors.append(str(exc))

        parts = [f"{total_meshes} mesh(es)"]
        if errors:
            parts.append(f"{len(errors)} error(s): {'; '.join(errors)}")
        out = ", ".join(parts)

except Exception as exc:
    out = f"ERROR: {exc}\n{traceback.format_exc()}"
# ---------- end ifckit_preview_element ----------

# ---- group: ifckit / Profiles
ifckit_preview_profile = IfckitPreviewProfile()  # -> out, profile_curve; inputs json_in: String
# ---------- ifckit_preview_profile: Python ----------
#
# gh_preview_profile.py  —  GH Script component: "ifckit Preview Profile"
# =========================================================================
#
# @component  nickname:"ifckit Preview Profile"
# @group "Profiles"
# @input  json_in          : str  item — Profile JSON (json_out from ifckit Profile node)
# @output out              : str  item — Status message
# @output profile_curve    : geometry item — Closed profile curve in WorldXY around origin

from __future__ import annotations

import json
import traceback

# ---------------------------------------------------------------------------
# Reload helper (development only — harmless in production)
# ---------------------------------------------------------------------------
try:
    import ifckit.rhinokit  # noqa: F401
    from ifckit.rhinokit import reload_all

    reload_all(__file__)
except Exception:
    pass

# ---------------------------------------------------------------------------
# Main
# ---------------------------------------------------------------------------
profile_curve = None
out = ""

try:
    if not json_in:
        raise ValueError("json_in is empty")

    d = json.loads(json_in)

    from ifckit.profiles.base import Profile
    from ifckit.rhinokit import profile_to_rhino_curve

    profile = Profile.dispatch_from_dict(d)
    profile_curve = profile_to_rhino_curve(profile)
    out = f"OK: {profile.__class__.__name__}"

except Exception as exc:
    out = f"ERROR: {exc}\n{traceback.format_exc()}"
# ---------- end ifckit_preview_profile ----------
ifckit_profile_2 = IfckitProfile()  # -> out, json_out; inputs profile_type: String, height: Double, width: Double, web_thickness: Double, flange_thickness: Double, radius: Double, wall_thickness: Double, steel_name: String, anchor: String, unit: String, name: String, rotation: Double, offset_x: Double, offset_y: Double
# ---------- ifckit_profile_2: Python ----------
#
# gh_profile.py  —  GH Script component: "ifckit Profile"
# =========================================================
#
# @component  nickname:"ifckit Profile"
# @group "Profiles"
# @input  profile_type     : str   item — Profile type: "I","L","rect","circle","hollow_circle","steel"
# @input  height           : float item — Height or leg A (m)
# @input  width            : float item — Width or leg B (m)
# @input  web_thickness    : float item — Web thickness (m) — I-beam only
# @input  flange_thickness : float item — Flange / leg thickness (m)
# @input  radius           : float item — Radius (m) — circle / hollow_circle
# @input  wall_thickness   : float item — Wall thickness (m) — hollow_circle
# @input  steel_name       : str   item — Steel section name, e.g. "HEA200"
# @input  anchor           : str   item — Anchor point: "c" centroid, "s" mid-bottom, "sw" bottom-left (default "c")
# @input  unit             : str   item — Unit for steel dims: "m" (default) or "mm"
# @input  name             : str   item — Optional profile label
# @input  rotation         : float item — CCW rotation of profile around its origin (radians, default 0)
# @input  offset_x         : float item — Additional X offset in profile plane (m, default 0)
# @input  offset_y         : float item — Additional Y offset in profile plane (m, default 0)
# @output out      : str item — Status message
# @output json_out : str  item — Profile JSON (Profile.to_dict() format)
#
# Stateless: creates any supported ifckit profile type and outputs a
# Profile.to_dict() JSON dict consumable by beam/wall/column nodes.

import json

from ifckit.profiles import (
    IBeamProfile, LBeamProfile,
    RectangleProfile, CircleProfile, HollowCircleProfile,
    SteelProfile,
)
from ifckit.schema import LengthUnit

_pt = (profile_type or "").strip().lower()
_anchor = (anchor or "c").strip().lower()
_rotation = float(rotation or 0)
_offset_x = float(offset_x or 0)
_offset_y = float(offset_y or 0)
messages = []
json_out = ""

try:
    profile = None

    if _pt == "i":
        h  = float(height or 0)
        w  = float(width or 0)
        wt = float(web_thickness or 0)
        ft = float(flange_thickness or 0)
        if h <= 0 or w <= 0 or wt <= 0 or ft <= 0:
            raise ValueError("height, width, web_thickness, flange_thickness all required for I-beam")
        profile = IBeamProfile(
            height=h, width=w, web_thickness=wt, flange_thickness=ft,
            anchor=_anchor, name=name or "I-Profile",
            rotation=_rotation, offset_x=_offset_x, offset_y=_offset_y,
        )

    elif _pt == "l":
        h  = float(height or 0)
        w  = float(width or 0)
        ft = float(flange_thickness or 0)
        if h <= 0 or w <= 0 or ft <= 0:
            raise ValueError("height, width, flange_thickness all required for L-beam")
        profile = LBeamProfile(
            height=h, width=w, thickness=ft,
            anchor=_anchor, name=name or "L-Profile",
            rotation=_rotation, offset_x=_offset_x, offset_y=_offset_y,
        )

    elif _pt == "rect":
        w = float(width or 0)
        h = float(height or 0)
        if w <= 0 or h <= 0:
            raise ValueError("width and height required for rect")
        profile = RectangleProfile(
            x_dim=w, y_dim=h, name=name or "Rect-Profile",
            rotation=_rotation, offset_x=_offset_x, offset_y=_offset_y,
        )

    elif _pt == "circle":
        r = float(radius or 0)
        if r <= 0:
            raise ValueError("radius required for circle")
        profile = CircleProfile(
            radius=r, name=name or "Circle-Profile",
            rotation=_rotation, offset_x=_offset_x, offset_y=_offset_y,
        )

    elif _pt == "hollow_circle":
        r  = float(radius or 0)
        wt = float(wall_thickness or 0)
        if r <= 0 or wt <= 0:
            raise ValueError("radius and wall_thickness required for hollow_circle")
        profile = HollowCircleProfile(
            radius=r, wall_thickness=wt, name=name or "HollowCircle-Profile",
            rotation=_rotation, offset_x=_offset_x, offset_y=_offset_y,
        )

    elif _pt == "steel":
        sname = (steel_name or "").strip()
        if not sname:
            raise ValueError("steel_name required for steel profile")
        u_str = (unit or "m").strip().lower()
        lu = LengthUnit.MILLIMETRE if u_str == "mm" else LengthUnit.METRE
        profile = SteelProfile.from_name(
            sname, anchor=_anchor, unit=lu,
            rotation=_rotation, offset_x=_offset_x, offset_y=_offset_y,
        )
        if name:
            profile.name = name

    else:
        raise ValueError(
            "profile_type must be one of: 'I', 'L', 'rect', 'circle', 'hollow_circle', 'steel'"
        )

    json_out = json.dumps(profile.to_dict())
    messages.append(f"OK  {profile.name or _pt}")

except Exception as exc:
    messages.append(f"ERR: {exc}")

out = "\n".join(messages) if messages else "No profile processed."
# ---------- end ifckit_profile_2 ----------

# ---- group: ifckit / Import
ifckit_spaces = IfckitSpaces()  # -> out; inputs ifc_path: String, run: Boolean, layer_root: String, hatch_pattern: String, import_fp: Boolean, import_hatch: Boolean, import_ann: Boolean, import_mesh: Boolean, mesh_quality: String, clear: Boolean
# ---------- ifckit_spaces: Python ----------
#
# gh_spaces.py  —  GH Script component: "ifckit Spaces"
# ======================================================
#
# @component  nickname:"ifckit Spaces"
# @group "Import"
# @input  ifc_path      : str   item — Absolute path to the .ifc file
# @input  run           : bool  item — Set True to import
# @input  layer_root    : str   item — Root layer name (default "IFC-Spaces")
# @input  hatch_pattern : str   item — Rhino hatch pattern for fills (default "Solid")
# @input  import_fp     : bool  item — Draw 2-D footprint curves (default True)
# @input  import_hatch  : bool  item — Draw hatch fills (default True)
# @input  import_ann    : bool  item — Draw TextDot labels (default True)
# @input  import_mesh   : bool  item — Tessellate 3-D bodies (default False)
# @input  mesh_quality  : str   item — Tessellation quality preset (default "default")
# @input  clear         : bool  item — Clear existing objects first (default True)
# @output out : str item — Status message
#
# Reads IfcSpace entities from an IFC file and draws footprint curves,
# hatches, annotations and/or 3-D mesh bodies in the active Rhino document.

from ifckit.rhino_import import IfcSpaceImporter

import scriptcontext as sc

# ---------------------------------------------------------------------------
# Resolve inputs
# ---------------------------------------------------------------------------
_ifc_path      = ifc_path      if ifc_path      else ""
_layer_root    = layer_root    if layer_root    else "IFC-Spaces"
_hatch_pattern = hatch_pattern if hatch_pattern else "Solid"
_import_fp     = import_fp     if import_fp  is not None else True
_import_hatch  = import_hatch  if import_hatch is not None else True
_import_ann    = import_ann    if import_ann  is not None else True
_import_mesh   = import_mesh   if import_mesh is not None else False
_mesh_quality  = mesh_quality  if mesh_quality else "default"
_clear         = clear         if clear is not None else True

out = ""

# ---------------------------------------------------------------------------
# Guards
# ---------------------------------------------------------------------------
if not _ifc_path:
    out = "Set ifc_path to the absolute path of the IFC file."

elif not run:
    out = (
        f"IFC file: {_ifc_path}\n"
        f"Layer root: {_layer_root!r}\n"
        f"Import: footprint={_import_fp}, hatch={_import_hatch}, "
        f"annotation={_import_ann}, mesh={_import_mesh}\n"
        "Set run=True to import."
    )

else:
    try:
        importer = IfcSpaceImporter(
            layer_root=_layer_root,
            hatch_pattern=_hatch_pattern,
            import_footprint=_import_fp,
            import_hatch=_import_hatch,
            import_annotation=_import_ann,
            import_mesh=_import_mesh,
            mesh_quality=_mesh_quality,
        )

        if _clear:
            removed = importer.clear()
            clear_msg = f"Cleared {removed} existing objects."
        else:
            clear_msg = ""

        result = importer.import_file(_ifc_path)

        lines = [
            f"Spaces:      {result['spaces']}",
            f"Footprints:  {result['footprints']}",
            f"Hatches:     {result['hatches']}",
            f"Annotations: {result['annotations']}",
            f"Meshes:      {result['meshes']}",
        ]
        if clear_msg:
            lines.append(clear_msg)
        out = "\n".join(lines)

    except Exception as exc:
        import traceback
        out = f"FAILED: {exc}\n{traceback.format_exc()}"

print(out)
# ---------- end ifckit_spaces ----------

# ----
p1 = Point(move_3.Geometry)

vec_11 = VectorXYZ(XComponent=0, YComponent=Slider(1000, range=0..10000), ZComponent=Slider(0, range=0..10000))  # -> Vector, Length
move_9 = Move(Geometry=p1, Motion=vec_11.Vector)  # -> Geometry, Transform

vec_12 = VectorXYZ(XComponent=0, YComponent=Slider(3378, range=0..10000), ZComponent=Slider(1798, range=0..10000))  # -> Vector, Length
move_10 = Move(Geometry=p1, Motion=vec_12.Vector)  # -> Geometry, Transform

p0_2 = Point(move.Geometry)
test_beam_2 = Text(ifckit_beam.json_out)

# ---- group: p3
number_slider_3 = Slider(3000, range=0..10000)

# ----
expression = Expression(x=number_slider_3, Expression="-x")

# ---- group: p3 (continued)
vec_13 = VectorXYZ(XComponent=Slider(0, range=0..10000), YComponent=Slider(8000, range=0..10000), ZComponent=expression)  # -> Vector, Length
move_11 = Move(Geometry=vec.Vector, Motion=vec_13.Vector)  # -> Geometry, Transform

# ----
number_slider_4 = Slider(0, range=0..10000)
vec_14 = VectorXYZ(XComponent=Slider(9000, range=0..10000), YComponent=Slider(0, range=0..10000), ZComponent=number_slider_3)  # -> Vector, Length
move_12 = Move(Geometry=move_11.Geometry, Motion=vec_14.Vector)  # -> Geometry, Transform

# ---- group: p2
number_slider_5 = Slider(0, range=0..10000)
vec_15 = VectorXYZ(XComponent=Slider(10000, range=0..10000), YComponent=Slider(0, range=0..10000), ZComponent=number_slider_3)  # -> Vector, Length
move_13 = Move(Geometry=move_11.Geometry, Motion=vec_15.Vector)  # -> Geometry, Transform

# ----
vec_16 = VectorXYZ(XComponent=Slider(2000, range=0..10000), YComponent=Slider(0, range=0..10000), ZComponent=Slider(0, range=0..10000))  # -> Vector, Length
move_14 = Move(Geometry=move_11.Geometry, Motion=vec_16.Vector)  # -> Geometry, Transform

vec_17 = VectorXYZ(XComponent=Slider(5000, range=0..10000), YComponent=Slider(0, range=0..10000), ZComponent=Slider(3810, range=0..10000))  # -> Vector, Length
move_15 = Move(Geometry=move_11.Geometry, Motion=vec_17.Vector)  # -> Geometry, Transform

pt_2 = Point([move_11.Geometry, move_14.Geometry, move_15.Geometry, move_12.Geometry, move_13.Geometry])
nurbs_2 = NurbsCurve(Vertices=pt_2, Degree=3, Periodic=False)  # -> Curve, Length, Domain
p3 = Point(move_11.Geometry)

expression_2 = Expression(x=Slider(2000, range=0..10000), Expression="-x")
vec_18 = VectorXYZ(XComponent=0, YComponent=expression_2, ZComponent=Slider(0, range=0..10000))  # -> Vector, Length
move_16 = Move(Geometry=p3, Motion=vec_18.Vector)  # -> Geometry, Transform

pt_3 = Point([p0, move_7.Geometry, move_8.Geometry, move_16.Geometry, p3])
nurbs_3 = NurbsCurve(Vertices=pt_3, Degree=3, Periodic=False)  # -> Curve, Length, Domain
p2 = Point(move_13.Geometry)
p3_2 = Point(move_11.Geometry)
expression_3 = Expression(x=Slider(1639, range=0..10000), Expression="-x")
vec_19 = VectorXYZ(XComponent=0, YComponent=expression_3, ZComponent=Slider(0, range=0..10000))  # -> Vector, Length

move_17 = Move(Geometry=p2, Motion=vec_19.Vector)  # -> Geometry, Transform

pt_4 = Point([p1, move_9.Geometry, move_10.Geometry, move_17.Geometry, p2])
nurbs_4 = NurbsCurve(Vertices=pt_4, Degree=3, Periodic=False)  # -> Curve, Length, Domain
edgesrf = EdgeSurface(CurveA=nurbs.Curve, CurveB=nurbs_2.Curve, CurveC=nurbs_3.Curve, CurveD=nurbs_4.Curve)
roof_srfsrf = Surface(edgesrf)

roof_srfsrf_2 = Surface(edgesrf)
p0_3 = Point(move.Geometry)
p3_3 = Point(move_11.Geometry)
p1_2 = Point(move_3.Geometry)
p2_2 = Point(move_13.Geometry)

p2_3 = Point(p2_2)
p3_4 = Point(p3_3)
p1_3 = Point(p1_2)

number_slider_6 = Slider(300, range=0..1000)
number_slider_7 = Slider(8, range=0..10)
expression_4 = Expression(x=number_slider_6, Expression="x/2")

number_slider_8 = Slider(80, range=0..1000)
number_slider_9 = Slider(8, range=0..10)
expression_5 = Expression(x=number_slider_8, Expression="x/2")

py3 = Python3Script(
    profile_type="I",
    anchor="n",
    height=number_slider_6,
    width=expression_4,
    web_thickness=number_slider_7,
    flange_thickness=number_slider_7,
    name="I-profiles")  # -> out, json_out; inputs profile_type: String, anchor: String, height: Double, width: Double, web_thickness: Double, flange_thickness: Double, name: String
# ---------- py3: Python ----------
"""
gh_profile.py  —  GH Script component: "Create Standard Profile"
================================================================

Stateless component: generates standard steel section profiles.

Component inputs
----------------
profile_type : str  — "I" for I-beam, "L" for L-beam.
height       : float — Total height (I-beam) or leg length A (L-beam), in meters.
width        : float — Flange width (I-beam) or leg length B (L-beam), in meters.
web_thickness: float — Web thickness (I-beam only), in meters.
flange_thickness: float — Flange thickness (both), in meters.
name         : str  — Optional profile name.

Component outputs
-----------------
out      : str — Status message.
json_out : str — JSON string representing the profile as a list of Vec tuples.
                 Can be used as profile input for beams, columns, etc.

Example — I-beam 200 mm height, 100 mm width, 6 mm web, 10 mm flange (in meters):
    profile_type = "I"
    height = 0.2
    width = 0.1
    web_thickness = 0.006
    flange_thickness = 0.01
"""

import json
from ifckit import IBeamProfile, LBeamProfile, Vec

profile_type = (profile_type or "").strip().upper()
messages = []
json_out = ""

if profile_type in ("I", "L"):
    try:
        h = float(height or 0)
        w = float(width or 0)
        wt = float(web_thickness or 0)
        ft = float(flange_thickness or 0)

        if h <= 0 or w <= 0:
            messages.append("ERR: height and width required")
        elif profile_type == "I" and (wt <= 0 or ft <= 0):
            messages.append("ERR: web_thickness and flange_thickness required for I-beam")
        elif profile_type == "L" and ft <= 0:
            messages.append("ERR: flange_thickness required for L-beam")
        else:
            if profile_type == "I":
                profile = IBeamProfile(
                    height=h, width=w, web_thickness=wt, flange_thickness=ft, name=name,
                    anchor=anchor
                )
            else:
                profile = LBeamProfile(
                    height=h, width=w, flange_thickness=ft, name=name, anchor=anchor
                )

            pts = profile.get_profile_points()
            vecs = [Vec(y, x, 0) for x, y in pts]
            profile_data = [v.to_tuple() for v in vecs]

            json_out = json.dumps({"profile": profile_data, "name": name or f"{profile_type}-Profile"})
            messages.append(f"OK  {profile_type}-beam ({h:.0f}×{w:.0f}mm)")
    except Exception as exc:
        messages.append(f"ERR: {exc}")
else:
    messages.append("ERR: profile_type must be 'I' or 'L'")

out = "\n".join(messages) if messages else "No profile processed."
print(out)
# ---------- end py3 ----------

py3_2 = Python3Script(
    profile_type="l",
    anchor="s",
    height=number_slider_8,
    width=number_slider_8,
    web_thickness=number_slider_9,
    flange_thickness=number_slider_9,
    name="I-profiles")  # -> out, json_out; inputs profile_type: String, anchor: String, height: Double, width: Double, web_thickness: Double, flange_thickness: Double, name: String
# ---------- py3_2: Python ----------
"""
gh_profile.py  —  GH Script component: "Create Standard Profile"
================================================================

Stateless component: generates standard steel section profiles.

Component inputs
----------------
profile_type : str  — "I" for I-beam, "L" for L-beam.
height       : float — Total height (I-beam) or leg length A (L-beam), in meters.
width        : float — Flange width (I-beam) or leg length B (L-beam), in meters.
web_thickness: float — Web thickness (I-beam only), in meters.
flange_thickness: float — Flange thickness (both), in meters.
name         : str  — Optional profile name.

Component outputs
-----------------
out      : str — Status message.
json_out : str — JSON string representing the profile as a list of Vec tuples.
                 Can be used as profile input for beams, columns, etc.

Example — I-beam 200 mm height, 100 mm width, 6 mm web, 10 mm flange (in meters):
    profile_type = "I"
    height = 0.2
    width = 0.1
    web_thickness = 0.006
    flange_thickness = 0.01
"""

import json
from ifckit import IBeamProfile, LBeamProfile, Vec

profile_type = (profile_type or "").strip().upper()
messages = []
json_out = ""

if profile_type in ("I", "L"):
    try:
        h = float(height or 0)
        w = float(width or 0)
        wt = float(web_thickness or 0)
        ft = float(flange_thickness or 0)

        if h <= 0 or w <= 0:
            messages.append("ERR: height and width required")
        elif profile_type == "I" and (wt <= 0 or ft <= 0):
            messages.append("ERR: web_thickness and flange_thickness required for I-beam")
        elif profile_type == "L" and ft <= 0:
            messages.append("ERR: flange_thickness required for L-beam")
        else:
            if profile_type == "I":
                profile = IBeamProfile(
                    height=h, width=w, web_thickness=wt, flange_thickness=ft, name=name,
                    anchor=anchor
                )
            else:
                profile = LBeamProfile(
                    height=h, width=w, thickness=ft, name=name, anchor=anchor
                )

            pts = profile.get_profile_points()
            vecs = [Vec(y, x, 0) for x, y in pts]
            profile_data = [v.to_tuple() for v in vecs]

            json_out = json.dumps({"profile": profile_data, "name": name or f"{profile_type}-Profile"})
            messages.append(f"OK  {profile_type}-beam ({h*1000:.0f}×{w*1000:.0f}mm)")
    except Exception as exc:
        messages.append(f"ERR: {exc}")
else:
    messages.append("ERR: profile_type must be 'I' or 'L'")

out = "\n".join(messages) if messages else "No profile processed."
print(out)
# ---------- end py3_2 ----------

p0_4 = Point(p0_3)
roof_srfsrf_3 = Surface(edgesrf)
p0_5 = Point(p0_3)
p1_4 = Point(p1_2)
devec = DeconstructVector(Vector=p0_5)  # -> XComponent, YComponent, ZComponent
devec_2 = DeconstructVector(Vector=p1_4)  # -> XComponent, YComponent, ZComponent
dom = ConstructDomain(DomainStart=devec.XComponent, DomainEnd=devec_2.XComponent)
div = DivideDomain(Domain=dom, Count=Slider(8, range=0..100))
dedomain = DeconstructDomain(Domain=div)  # -> Start, End
vec_20 = VectorXYZ(XComponent=dedomain.Start, YComponent=0, ZComponent=0)  # -> Vector, Length
vec_21 = VectorXYZ(XComponent=devec_2.XComponent, YComponent=0, ZComponent=0)  # -> Vector, Length
pt_5 = Point(flatten([vec_20.Vector, vec_21.Vector]))

vec_22 = VectorXYZ(XComponent=Slider(0, range=0..1), YComponent=Slider(1, range=0..1), ZComponent=Slider(0, range=0..1))  # -> Vector, Length
move_18 = Move(Geometry=p0_4, Motion=vec_22.Vector)  # -> Geometry, Transform

vec_23 = VectorXYZ(XComponent=Slider(0, range=0..1), YComponent=Slider(0, range=0..1), ZComponent=Slider(1, range=0..1))  # -> Vector, Length
move_19 = Move(Geometry=p0_4, Motion=vec_23.Vector)  # -> Geometry, Transform

pl_3pt = Plane3Pt(PointA=p0_4, PointB=move_18.Geometry, PointC=move_19.Geometry)
base_cutting_plane = Plane(pl_3pt)
move_20 = Move(Geometry=base_cutting_plane, Motion=pt_5)  # -> Geometry, Transform
sec = BrepPlane(Brep=roof_srfsrf_3, Plane=move_20.Geometry)  # -> Curves, Points
curve_biarcs = CurveBiarcs(Curve=sec.Curves, Tolerance=Slider(10, range=0..10), MaxDepth=Slider(2, range=0..10))  # -> ArcsLines, Info, MaxDeviation
panel_3 = Panel(curve_biarcs.ArcsLines)
roof_arcs = Curve(curve_biarcs.ArcsLines)

base_cutting_plane_2 = Plane(pl_3pt)
roof_arcs_2 = Curve(curve_biarcs.ArcsLines)
py3_3 = Python3Script(arcs=roof_arcs_2, rh_plane=base_cutting_plane_2, profile_json=py3.json_out, name="swept beam")  # -> out, flatten(json_out); inputs arcs: list of Arc, profile_json: String, profile_pts: list of Point3d, name: String
# ---------- py3_3: Python ----------
"""
gh_create_revolved_beam.py  —  GH Script component: "Create IFC Revolved Beam"
================================================================================

Stateless component: serializes arc/line-based beam paths to JSON strings.
Handles list of arcs (from biarc reduction) → multiple IfcRevolvedAreaSolid via PendingRevolvedBeam.

Component inputs
----------------
arcs         : list — Rhino ArcCurve objects (from biarc reduction).
                  May have mixed normals (concave vs convex).
profile_pts  : list — Rhino Point3d objects defining the cross-section
                    polygon in the local XY plane (X = width, Y = up).
                    Minimum 3 points; no closing duplicate needed.
profile_json: str  — JSON string from gh_profile.py (alternative to profile_pts).
                    Takes precedence if both are provided.
name          : str  — Optional element name prefix.
plane_normal : list — [x, y, z] canonical plane normal (default: [1, 0, 0]).

Component outputs
-----------------
out      : str  — Status message.
json_out : list — List of JSON strings (one per beam segment).
"""
# Add at top of script:
import gc
gc.collect()

import math
import json
import os
import sys
import importlib


_fallback_path = r'/Users/Mauc/L140-py-ifckit'
pkg_path = os.environ.get('IFCKIT_PATH', _fallback_path)
if pkg_path not in sys.path:
    sys.path.insert(0, pkg_path)

import ifckit
import ifckit.geometry
import ifckit.builders
import ifckit.builders.beam_factory
import ifckit.builders.revolved_beam
import ifckit.elements
import ifckit.rhinokit

importlib.reload(ifckit.geometry)
importlib.reload(ifckit.elements)
importlib.reload(ifckit.builders)
importlib.reload(ifckit.builders.beam_factory)
importlib.reload(ifckit.builders.revolved_beam)
importlib.reload(ifckit.rhinokit)
importlib.reload(ifckit)

from ifckit import PendingRevolvedBeam, Vec
from ifckit.geometry import assemble_path
import ifckit.rhinokit as rk

if rh_plane is None:
    print("no plane")
plane_normal = Vec(
    rh_plane.Normal.X, 
    rh_plane.Normal.Y,
    rh_plane.Normal.Z)

def _get_profile():
    """Get profile from profile_json or profile_pts."""
    if profile_json:
        try:
            data = json.loads(profile_json)
            pts = data.get("profile", [])
            return [Vec(*pt) for pt in pts]
        except Exception:
            pass

    if profile_pts:
        return rk.pts_to_vecs(profile_pts)

    return None



messages = []
json_outputs = []

if arcs:
    prof = _get_profile()
    if not prof:
        messages.append("ERR: no profile (provide profile_pts or profile_json)")
    else:
        normal = Vec(*plane_normal) if plane_normal else Vec(1, 0, 0)

        ifckit_arcs = []
        for rh_arc in arcs:
            ifckit_arc = rk.arc_to_arc(rh_arc)
            if not ifckit_arc:
                messages.append(f"ERR: invalid arc curve")
                continue
            ifckit_arcs.append(ifckit_arc)

        if not ifckit_arcs:
            messages.append("ERR: no valid arcs")
        else:
            paths = assemble_path(ifckit_arcs)

            for path_idx, path in enumerate(paths):
                for seg_idx, seg in enumerate(path.segments):
                    from ifckit.geometry import Arc, Line
                    if isinstance(seg, Line):
                        messages.append(f"WRN: Line segment {seg_idx} in path {path_idx} — skipped (revolved beam requires arc)")
                        continue

                    try:
                        el_name = f"{name or 'RevolvedBeam'}_{path_idx}_{seg_idx}"
                        # Pass cp_normal to ensure profile continuity when arc normals differ
                        beam = PendingRevolvedBeam(arc=seg, profile=prof, name=el_name, cp_normal=normal)
                        json_outputs.append(beam.to_json())
                        angle_deg = math.degrees(abs(seg.angle))
                        messages.append(f"OK  {el_name} ({angle_deg:.0f}° arc)")
                    except Exception as exc:
                        messages.append(f"ERR {el_name}: {exc}")

elif not arcs:
    messages.append("No arcs")

out = "\n".join(messages) if messages else "No beams processed."
print(out)
json_out = json_outputs if json_outputs else []
# ---------- end py3_3 ----------
ipe_beams = Text(py3_3.json_out)

p0_6 = Point(p0_3)
p0_7 = Point(p0_3)
roof_srfsrf_4 = Surface(edgesrf)
devec_3 = DeconstructVector(Vector=p3_4)  # -> XComponent, YComponent, ZComponent
devec_4 = DeconstructVector(Vector=p1_3)  # -> XComponent, YComponent, ZComponent

vec_24 = VectorXYZ(XComponent=Slider(1, range=0..1), YComponent=Slider(1, range=0..1), ZComponent=Slider(0, range=0..1))  # -> Vector, Length
move_21 = Move(Geometry=p0_6, Motion=vec_24.Vector)  # -> Geometry, Transform

vec_25 = VectorXYZ(XComponent=Slider(0, range=0..1), YComponent=Slider(0, range=0..1), ZComponent=Slider(1, range=0..1))  # -> Vector, Length
move_22 = Move(Geometry=p0_6, Motion=vec_25.Vector)  # -> Geometry, Transform

vec_26 = VectorXYZ(XComponent=devec_4.XComponent, YComponent=devec_4.YComponent, ZComponent=0)  # -> Vector, Length
vec_27 = VectorXYZ(XComponent=devec_3.XComponent, YComponent=devec_3.YComponent, ZComponent=0)  # -> Vector, Length
ln_2 = Line(StartPoint=vec_26.Vector, EndPoint=vec_27.Vector)
divide = DivideCurve(Curve=ln_2, Count=Slider(15, range=0..100), Kinks=False)  # -> Points, Tangents, Parameters

pl_3pt_2 = Plane3Pt(PointA=p0_6, PointB=move_21.Geometry, PointC=move_22.Geometry)
base_cutting_plane_3 = Plane(pl_3pt_2)
pt_6 = Point(flatten(divide.Points))
move_23 = Move(Geometry=base_cutting_plane_3, Motion=pt_6)  # -> Geometry, Transform
sec_2 = BrepPlane(Brep=roof_srfsrf_4, Plane=move_23.Geometry)  # -> Curves, Points
curve_biarcs_2 = CurveBiarcs(Curve=sec_2.Curves, Tolerance=Slider(10, range=0..10), MaxDepth=Slider(3, range=0..10))  # -> ArcsLines, Info, MaxDeviation
panel_4 = Panel(curve_biarcs_2.ArcsLines)
roof_arcs_2_2 = Curve(curve_biarcs_2.ArcsLines)

roof_arcs_2_3 = Curve(curve_biarcs_2.ArcsLines)
base_cutting_plane_4 = Plane(pl_3pt_2)
py3_4 = Python3Script(arcs=roof_arcs_2_3, rh_plane=base_cutting_plane_4, profile_json=py3_2.json_out, name="swept beam")  # -> out, flatten(json_out); inputs arcs: list of Arc, profile_json: String, profile_pts: list of Point3d, name: String; same code as py3_3
l_beams = Text(py3_4.json_out)

l_beams_2 = Text(py3_4.json_out)
ipe_beams_2 = Text(py3_3.json_out)
txt = Text(flatten([ipe_beams_2, l_beams_2, test_beam_2]))
storey_collect = Python3Script(storey_name="test storey", elements=txt, elevation=Slider(0, range=0..10000))  # -> out, json_out; inputs storey_name: String, elements: list of String, elevation: Double
# ---------- storey_collect: Python ----------
"""
gh_collector.py — GH Script: "Collect Elements"
================================================

One collector per storey. Multiple collectors feed into Build JSON.

Flow:  [Collector A] ──┐
       [Collector B] ──┼──→ [Build JSON] ──→ [Export/Preview]
       [Collector C] ──┘

Inputs
------
elements      : list  — List of JSON strings (walls, beams, etc.)
storey_name   : str   — Storey name, e.g. "Ground Floor"
elevation     : float — Storey floor elevation in model units (default 0.0)

Output
------
out      : str — Status message.
json_out : str — {"storey_name": ..., "elevation": ..., "elements": [...]}
"""

import json

messages = []
all_elements = []

if elements:
    elems = elements if isinstance(elements, list) else [elements]
    all_elements.extend([e for e in elems if e])
    messages.append("Added {} elements".format(len(all_elements)))

out = ", ".join(messages) if messages else "No elements"

sname = str(storey_name) if storey_name else "Default"
elev = float(elevation) if elevation is not None else 0.0

output_data = {
    "storey_name": sname,
    "elevation": elev,
    "elements": all_elements,
}
json_out = json.dumps(output_data, separators=(",", ":"))

print(out)
# ---------- end storey_collect ----------
panel_5 = Panel("zero")
building_site_project = Python3Script(
    json_input=storey_collect.json_out,
    project_name="test project",
    author="test author",
    unit="MILLIMETRE",
    ifc_version="IFC2X3")  # -> out, json_out; inputs json_input: String, project_name: String, author: String, unit: String, ifc_version: String
# ---------- building_site_project: Python ----------
"""
gh_build_json.py — GH Script: "Build IFC JSON"
===============================================

Stateless: merges multiple Collector outputs into a full IFC project JSON.

Flow:  [Collector A] ──┐
       [Collector B] ──┼──→ [Build JSON] ──→ [Export/Preview]
       [Collector C] ──┘

Inputs
------
json_input   : list — JSON strings from Collectors (one per storey).
project_name : str  — IFC project name (default "GH Project").
author       : str  — Author string stored in IFC header (default "GH").
unit         : str  — "METRE" or "MILLIMETRE" (default "MILLIMETRE").
ifc_version  : str  — "IFC2X3" or "IFC4" (default "IFC2X3").

Outputs
-------
out      : str — Status message (element count or error).
json_out : str — Full IFC project JSON ready for Export/Preview node.
"""

import json

out = ""
json_out = ""

if not json_input:
    out = "ERROR: no JSON input."
else:
    try:
        _project_name = str(project_name) if project_name else "GH Project"
        _author = str(author) if author else "GH"
        _unit = str(unit).upper() if unit else "MILLIMETRE"
        _ifc_version = str(ifc_version).upper() if ifc_version else "IFC2X3"

        inputs = json_input if isinstance(json_input, list) else [json_input]

        storeys_out = []
        total = 0

        for item in inputs:
            s = str(item).strip()
            if not s:
                continue
            storey = json.loads(s)
            sname = storey.get("storey_name", "Default")
            elev = float(storey.get("elevation", 0.0))
            elems = storey.get("elements", [])
            parsed = [json.loads(e) if isinstance(e, str) else e for e in elems]
            storeys_out.append(
                {
                    "name": sname,
                    "elevation": elev,
                    "elements": parsed,
                }
            )
            total += len(parsed)

        project_json = {
            "ifc_version": _ifc_version,
            "project": {"name": _project_name, "author": _author},
            "unit": _unit,
            "site": {"name": "Site"},
            "buildings": [{"name": "Building", "storeys": storeys_out}],
            "drawings": [
                {
                "name": "Ground Floor Plan",
                "target_view": "PLAN_VIEW",
                "origin": [0.0, 0.0, 1200.0],
                "x_axis": [1.0, 0.0, 0.0],
                "z_axis": [0.0, 0.0, -1.0]
                },
                {
                "name": "Doorsnede A-A",
                "target_view": "SECTION_VIEW",
                "origin": [0.0, 5000.0, 0.0],
                "x_axis": [1.0, 0.0, 0.0],
                "z_axis": [0.0, 1.0, 0.0]
                },
                {
                "name": "Vooraanzicht",
                "target_view": "ELEVATION_VIEW",
                "origin": [0.0, -1000.0, 0.0],
                "x_axis": [1.0, 0.0, 0.0],
                "z_axis": [0.0, 1.0, 0.0]
                }
            ]
        
        }

        out = "Built project JSON: {} elements across {} storey(s).".format(
            total, len(storeys_out)
        )
        json_out = json.dumps(project_json, separators=(",", ":"))

    except Exception as exc:
        out = "FAILED: {}".format(exc)

print(out)
# ---------- end building_site_project ----------
relative_path = Python3Script(name="ifckit-folly_00")  # -> out, a
# ---------- relative_path: Python ----------
from pathlib import Path
myname = "output/{}.ifc".format(name)
p = Path(ghenv.Component.OnPingDocument().FilePath).parent
 
if name:
    a = str(p / myname)
else:
    a = str(p)

print(a)
# ---------- end relative_path ----------
ifc_export = Python3Script(
    json_input=building_site_project.json_out,
    ifc_output=relative_path.a,
    run_export=Toggle(True),
    run_preview=Toggle(True),
    run_svg=Toggle(False),
    mesh_quality="superfine",
    z_mode="storey",
    sticky_key="model")  # -> out, model_ready; inputs json_input: String, ifc_output: String, run_export: Boolean, run_preview: Boolean, run_svg: Boolean, mesh_quality: String, z_mode: String, sticky_key: String
# ---------- ifc_export: Python ----------
"""
gh_export_json.py — GH Script: "Export / Preview IFC"
======================================================

Builds an IFC model from JSON, optionally exports to file and/or previews
meshes in Rhino, and stores the model in ``sc.sticky`` for downstream
drawing nodes (gh_drawing.py).

Flow:  [Build JSON json_out] ──→ [Export / Preview]
                                       │ model_ready
                                       ▼
                               [Drawing node ×N]

Component inputs
----------------
json_input     : str  — Full IFC project JSON from Build JSON node.
ifc_output     : str  — Absolute path for the output .ifc file (optional).
run_export     : bool — Set True to write the IFC file (requires ifc_output).
run_preview    : bool — Set True to import meshes into Rhino.
mesh_quality   : str  — Preview tessellation quality
                          (superfine/fine/default/coarse/supercoarse).
sticky_key     : str  — sc.sticky key under which the model is stored
                          (default "ifckit_model").  Change only when running
                          multiple independent IFC models side by side.

Component outputs
-----------------
out          : str  — Status message (element count, file path, or error).
model_ready  : int  — Increments on every successful build.  Wire to
                       drawing nodes so they know a new model is available.
                       Does NOT auto-trigger drawing nodes — each drawing
                       node has its own run=True guard.
"""

import json
import sys
import importlib

import os
_fallback_path = r'/Users/Mauc/L140-py-ifckit'
pkg_path = os.environ.get('IFCKIT_PATH', _fallback_path)
if pkg_path not in sys.path:
    sys.path.insert(0, pkg_path)

from ifckit.rhinokit import reload_all
reload_all()
from ifckit.json_build import build

import scriptcontext as sc

_quality    = mesh_quality if mesh_quality else "default"
_sticky_key = sticky_key   if sticky_key   else "ifckit_model"
_ver_key    = _sticky_key + "_version"

out         = ""
model_ready = sc.sticky.get(_ver_key, 0)  # expose current version even when idle

if not json_input:
    out = "ERROR: no JSON input."
elif not run_export and not run_preview:
    try:
        data = json.loads(json_input)
        total = sum(
            len(s.get("elements", []))
            for b in data.get("buildings", [])
            for s in b.get("storeys", [])
        )
        lines = [f"Model has {total} elements."]
        if ifc_output:
            lines.append(f"Set run_export=True to export to:\n  {ifc_output}")
        lines.append("Set run_preview=True to preview in Rhino.")
        out = "\n".join(lines)
    except json.JSONDecodeError as exc:
        out = f"ERROR: Invalid JSON: {exc}"
else:
    try:
        data  = json.loads(json_input)
        model = build(data)
        messages = []

        if run_export:
            if not ifc_output:
                messages.append("EXPORT SKIPPED: ifc_output is empty.")
            else:
                model.save(ifc_output)
                messages.append(f"Exported to:\n  {ifc_output}")

        if run_preview:
            count = model.preview_rhino(mesh_quality=_quality)
            messages.append(f"Previewing {count} elements in Rhino.")

        # Store model in sticky for drawing nodes.
        sc.sticky[_sticky_key] = model
        sc.sticky[_ver_key]    = sc.sticky.get(_ver_key, 0) + 1
        model_ready            = sc.sticky[_ver_key]
        messages.append(f"Model stored (version {model_ready}).")

        out = "\n".join(messages)

    except Exception as exc:
        import traceback
        out = f"FAILED: {exc}\n{traceback.format_exc()}"

print(out)
# ---------- end ifc_export ----------

panel_6 = Panel(relative_path.a)

number_slider_10 = Slider(20000, range=0..100000)
toggle = BooleanToggle(False)
py3_5 = Python3Script(loc_y=number_slider_10)  # -> out, a; inputs loc_x: Double, loc_y: Double, offset_x: Double, offset_y: Double
# ---------- py3_5: Python ----------
# import System.Drawing
# from ifckit import rhinokit as rk
# import scriptcontext as sc
# idx = rk.ensure_layer(
#     sc.doc,
#     "Annotations::NoPlot",
#     color=System.Drawing.Color.Magenta,
#     plot_weight=0.0,
# )

import Rhino.Geometry as rg
_loc_x = loc_x if loc_x else 0.0
_loc_y = loc_y if loc_y else 0.0
_offset_x = offset_x if offset_x else 0.0
_offset_y = offset_y if offset_y else 0.0

origin = rg.Vector3d(_loc_x, _loc_y, 0)
loc = origin + rg.Vector3d(_offset_x, _offset_y,0)
plane = rg.Plane(rg.Point3d(loc), rg.Vector3d(0,0,1))

a=plane
# ---------- end py3_5 ----------
py3_6 = Python3Script(run=Button(), model_ready=ifc_export.model_ready, sticky_key="model", drawing_name="Doorsnede A-A", dest_plane=py3_5.a)  # -> out, a; inputs run: Boolean, model_ready: Int32, sticky_key: String, drawing_name: String, hlr_poly: Boolean, mesher_defl: Double, hatch_pattern: String, clear: Boolean, dest_plane: Plane
# ---------- py3_6: Python ----------
"""
gh_drawing.py — GH Script: "Generate Drawing"
==============================================

Imports one named IFC drawing (section plane + projection) into the active
Rhino document as curves and hatches.  The model is read from ``sc.sticky``
as stored by gh_export_json.py.

Each run replaces only the curves/hatches for the requested drawing (when
``clear=True``), leaving all other drawings untouched.

Flow:  [Export/Preview model_ready] ──→ [Generate Drawing ×N]

Wire the same ``model_ready`` output to all drawing nodes.  Each node is
independent: set its own ``run=True`` when you want to (re)generate that
particular drawing.

Component inputs
----------------
model_ready   : int   — From Export node.  Shown in status to confirm which
                         model version is loaded.  Does NOT auto-run this node.
drawing_name  : str   — Exact name of the IfcAnnotation[ObjectType=DRAWING]
                         to generate (e.g. "Ground Floor Plan").
run           : bool  — Set True to generate the drawing.  Generation can
                         take 10–120 s depending on model complexity.
hlr_poly      : bool  — Use polygonal HLR (default True, same as Bonsai).
                         Set False for exact BREP HLR (slower, more precise).
mesher_defl   : float — OCC mesher linear deflection in metres (default None
                         = ifcopenshell default ~0.001 m).  Try 0.01 for
                         ~4× speedup on curved profiles.
hatch_pattern : str   — Fallback Rhino hatch pattern name for elements that
                         do not have EPset_IfcKit.HatchPattern set
                         (default "Solid").
clear         : bool  — If True (default), remove existing curves/hatches for
                         this drawing before regenerating.
sticky_key    : str   — sc.sticky key to read the model from
                         (default "ifckit_model").  Must match the key used
                         in gh_export_json.py.
dest_plane    : Plane — Rhino Plane onto which the drawing is placed using
                         PlaneToPlane (scale 1:1).  Leave unconnected to keep
                         the drawing on its section plane in world space.

Component outputs
-----------------
out  : str  — Status message (curve count, hatch count, or error).
"""

import sys
import importlib

import os
_fallback_path = r'/Users/Mauc/L140-py-ifckit'
pkg_path = os.environ.get('IFCKIT_PATH', _fallback_path)
if pkg_path not in sys.path:
    sys.path.insert(0, pkg_path)

import ifckit
import ifckit.geometry
import ifckit.elements
import ifckit.builders
import ifckit.builders._geom
import ifckit.builders.base
import ifckit.builders.extruded
import ifckit.builders.wall
import ifckit.builders.slab
import ifckit.builders.beam_factory
import ifckit.builders.revolved_beam
import ifckit.builders.bridge
import ifckit.rhinokit
import ifckit.rhino_import
import ifckit.model
import ifckit.validator
import ifckit.json_build

importlib.reload(ifckit.geometry)
importlib.reload(ifckit.elements)
importlib.reload(ifckit.builders._geom)
importlib.reload(ifckit.builders.base)
importlib.reload(ifckit.builders.extruded)
importlib.reload(ifckit.builders.wall)
importlib.reload(ifckit.builders.slab)
importlib.reload(ifckit.builders.beam_factory)
importlib.reload(ifckit.builders.revolved_beam)
importlib.reload(ifckit.builders.bridge)
importlib.reload(ifckit.builders)
importlib.reload(ifckit.rhinokit)
importlib.reload(ifckit.model)
importlib.reload(ifckit.validator)
importlib.reload(ifckit.json_build)
importlib.reload(ifckit.rhino_import)
importlib.reload(ifckit)

from ifckit.rhino_import import IfcSvgImporter

import scriptcontext as sc

# ---------------------------------------------------------------------------
# Resolve inputs
# ---------------------------------------------------------------------------
_sticky_key    = sticky_key    if sticky_key    else "ifckit_model"
_drawing_name  = drawing_name  if drawing_name  else ""
_hlr_poly      = hlr_poly      if hlr_poly is not None else True
_mesher_defl   = float(mesher_defl) if mesher_defl else None
_hatch_pattern = hatch_pattern if hatch_pattern else "Solid"
_clear         = clear         if clear is not None else True
_model_ready   = model_ready   if model_ready is not None else 0

# Destination plane — None means keep drawing on section plane.
_dest_plane = dest_plane if dest_plane is not None else None

out = ""

# ---------------------------------------------------------------------------
# Guards
# ---------------------------------------------------------------------------
if not _drawing_name:
    out = "Set drawing_name to the exact name of the drawing to generate."

elif not run:
    model = sc.sticky.get(_sticky_key)
    if model is None:
        out = (
            f"No model in sc.sticky[{_sticky_key!r}].\n"
            "Run the Export node first, then set run=True here."
        )
    else:
        lines = [
            f"Model ready (version {_model_ready}).",
            f"Drawing: {_drawing_name!r}",
        ]
        if _dest_plane is not None:
            lines.append(f"Destination plane: {_dest_plane.Origin}")
        lines.append("Set run=True to generate.")
        out = "\n".join(lines)

else:
    # -----------------------------------------------------------------------
    # Generate
    # -----------------------------------------------------------------------
    model = sc.sticky.get(_sticky_key)

    if model is None:
        out = (
            f"ERROR: no model found in sc.sticky[{_sticky_key!r}].\n"
            "Run the Export node first."
        )
    else:
        try:
            importer = IfcSvgImporter(hatch_pattern=_hatch_pattern)

            if _clear:
                removed = importer.clear_drawing(_drawing_name)
                clear_msg = f"Cleared {removed} existing objects."
            else:
                clear_msg = ""

            result = importer.import_model(
                model,
                hlr_poly=_hlr_poly,
                mesher_deflection=_mesher_defl,
                drawing_filter=_drawing_name,
                destination_plane=_dest_plane,
            )

            lines = [
                f"Drawing:  {_drawing_name!r}",
                f"Curves:   {result['curves']}",
                f"Hatches:  {result['hatches']}",
            ]
            if _dest_plane is not None:
                lines.append(f"Placed on destination plane: {_dest_plane.Origin}")
            if clear_msg:
                lines.append(clear_msg)
            out = "\n".join(lines)

        except Exception as exc:
            import traceback
            out = f"FAILED: {exc}\n{traceback.format_exc()}"

print(out)
# ---------- end py3_6 ----------
planesrf = PlaneSurface(Plane=py3_5.a, XSize=number_slider_10, YSize=number_slider_10)

number_slider_11 = Slider(20000, range=0..100000)
toggle_2 = BooleanToggle(False)
py3_7 = Python3Script(loc_x=Slider(20000, range=0..100000), loc_y=number_slider_11)  # -> out, a; inputs loc_x: Double, loc_y: Double, offset_x: Double, offset_y: Double; same code as py3_5
py3_8 = Python3Script(run=Button(), model_ready=ifc_export.model_ready, sticky_key="model", drawing_name="Vooraanzicht", dest_plane=py3_7.a)  # -> out, a; inputs run: Boolean, model_ready: Int32, sticky_key: String, drawing_name: String, hlr_poly: Boolean, mesher_defl: Double, hatch_pattern: String, clear: Boolean, dest_plane: Plane; same code as py3_6
planesrf_2 = PlaneSurface(Plane=py3_7.a, XSize=number_slider_11, YSize=number_slider_11)
